# Grasshopper definition chp.gh (Grasshopper 1.0.7)
# plug-ins: sia380, sia2028, combustion, sia2024

# ---- group: SIA heating loads
number_slider = Slider(1, range=1..12)
python = GhPythonScript(month=number_slider)  # -> out, season; inputs month: Int32
# ---------- python: Python ----------
__author__ = "chwaibel"
__version__ = "2019.11.06"

import rhinoscriptsyntax as rs

summerstart = 3 # summer starts in march
summerend = 9  # summer ends in end of September

if month >= summerstart and month <= summerend:
    season = "summer"
else:
    season = "winter"
# ---------- end python ----------
list = ValueList({"standard", "ideal", "existing"}, selected="standard")
list_2 = ValueList({"mfh", "efh", "office", "school"}, selected="mfh")
sia2024 = SIA2024(Use_case=list_2, Bldgtype=list, Month=number_slider, Season=python.season)  # -> Τ_h, Θ_i_C, T_h, A_op_m2, A_w_m2, U_op_W_m2K, U_w_W_m2K, V_e_m3_h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
sia2028 = SIA2028(Month=number_slider)  # -> IHor_Wh_m2, IE_Wh_m2, IS_Wh_m2, IW_Wh_m2, IN_Wh_m2, Θ_e_C
sia380 = SIA3801(
    Tau=sia2024.Τ_h,
    Theta_e=sia2028.Θ_e_C,
    Theta_i=sia2024.Θ_i_C,
    T=sia2024.T_h,
    A_op=sia2024.A_op_m2,
    A_w=sia2024.A_w_m2,
    U_op=sia2024.U_op_W_m2K,
    U_w=sia2024.U_w_W_m2K,
    Vdot_e=sia2024.V_e_m3_h,
    Vdot_inf=sia2024.V_inf_m3_h,
    Eta_rec=sia2024.Η_rec_,
    Phi_P=sia2024.Φ_P_W,
    Phi_B=sia2024.Φ_L_W,
    Phi_G=sia2024.Φ_G_W,
    T_P=sia2024.T_P_h,
    T_B=sia2024.T_L_h,
    T_G=sia2024.T_A_h,
    G=sia2024.G_,
    F_sh=sia2024.F_sh_,
    I=sia2028.IHor_Wh_m2)  # -> Q_H, Q_T, Q_V, Eta_g, Q_i, Q_s
panel = Panel([sia380.Q_H, sia380.Q_T, sia380.Q_V, sia380.Eta_g, sia380.Q_i, sia380.Q_s])

# ---- group: CHP
division = Division(A=sia380.Q_H, B="1000")
panel_2 = Panel("elec_in")
chp = Chp(Loads=division, Eta="0.33", Htp="1.57", Fuelcost="0.09", Fuelemissions="0.237")  # -> Total_cost, Total_emissions, Heating_gen, Elec_gen
panel_3 = Panel([chp.Total_cost, chp.Total_emissions, chp.Heating_gen, chp.Elec_gen])
