# Grasshopper definition simplest_panel.gh (Grasshopper 1.0.7)
# plug-ins: solar, solarParameters

pveffl = PVEfficiency({"Silicone": {"PV tech": "Silicone", "efficiency": 0.10000000000000001}, "Monocrystalline": {"PV tech": "Monocrystalline", "efficiency": 0.14999999999999999}, "Polycrystalline": {"PV tech": "Polycrystalline", "efficiency": 0.20000000000000001}, "Super-duper-tech": {"PV tech": "Super-duper-tech", "efficiency": 0.25}}, selected="Super-duper-tech")
prl = PerformanceRatio({"Roof perfect": {"Scenario": "Roof perfect", "performance ratio": 0.84999999999999998}, "Roof normal": {"Scenario": "Roof normal", "performance ratio": 0.75}, "Roof dirty": {"Scenario": "Roof dirty", "performance ratio": 0.69999999999999996}, "Facade perfect": {"Scenario": "Facade perfect", "performance ratio": 0.75}, "Facade normal": {"Scenario": "Facade normal", "performance ratio": 0.69999999999999996}, "Facade shaded": {"Scenario": "Facade shaded", "performance ratio": 0.59999999999999998}}, selected="Roof perfect")
perfrat = PerformanceRatio(Performance_scenario=prl)
pveff = PVEfficiency(PV_tech=pveffl)
eacspanel = EaCSPanel(Global_Irradiation="10000", PVEfficiency=pveff, PerformanceRatio=perfrat)
panel = Panel(eacspanel)
