# Grasshopper definition Hive_PhotovoltaicEnergySystem.gh (Grasshopper 1.0.7)
# plug-ins: Hive.Core.solar_tech

panel = Panel("1")
panel_2 = Panel("0.15")
# Q: How to upload files in Wiki? Do I need to make a Pull Request?
panel_3 = Panel("0.75")
# "Note: Move "A" to the top of the inputs list.
# 
# Change "A" to "Area".
# Change "G" to "Irrad"
# 
# Reason: Consistency w/ other components.
# Q: Add more description here?
kwh_m² = Panel("1200")
m² = Panel("12")
pvsimple = PhotovoltaicEnergySystem(Global_Irradiation=kwh_m², FormFactor=panel, SurfaceArea=m², PVEfficiency=panel_2, PerformanceRatio=panel_3)
kwh = Panel(pvsimple)
