# Grasshopper definition Hive_PhotovoltaicTimeResolvedEnergySystem.gh (Grasshopper 1.0.7)
# plug-ins: HiveIO, Hive.Core.solar_tech

# ---- group: Path to weather file (.epw)
panel = Panel("C:\Users\HIVE_Zurich.epw")

# ----
distepw = DistributorEPW(EPWFilepath=panel, WriteLists=Toggle(True))  # -> EPW, Latitude, Longitude, CityCountry, GHI, DNI, DHI, DryBulb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
m² = Panel("12")
panel_2 = Panel("20")
panel_3 = Panel("800")
panel_4 = Panel("0.15")
panel_5 = Panel("0.004")
panel_6 = Panel("45")
pvtimeresolved = PhotovoltaicTimeResolvedEnergySystem(
    A=m²,
    Eta_PVref=panel_4,
    Beta=panel_5,
    NOCT=panel_6,
    NOCT_ref=panel_2,
    NOCT_sol=panel_3,
    T_amb=distepw.DryBulb,
    I=distepw.GHI)  # -> Elec, Effic
panel_7 = Panel(pvtimeresolved.Elec)
