# Grasshopper definition Hive_SolarPotentialsUnobstructed.gh (Grasshopper 1.0.7)
# plug-ins: HiveIO, Hive.Core.solar, GHSolar

# ---- group: Path to weather file (.epw)
# Instructions: Add the weather file path (on your laptop) in this yellow panel.
panel = Panel("C:\Users\HIVE_Zurich.epw")

# ---- group: surface orientation
number_slider = Slider(33.169, range=0..90)
number_slider_2 = Slider(108.001, range=0..360)

# ---- group: Sky view factor
toggle = BooleanToggle(True)
number_slider_3 = Slider(2, range=0..5)
number_slider_4 = Slider(0.25, range=0..1)

# ---- group: Sky view factor / Context (City, obstacles, etc.)
mesh = Mesh([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])

# ---- group: Sky view factor / analysis point
pt = Point(Point(21.71647424, -7.258711689, 0))

# ----
# Sunpath and unobstructred surface insolation
toggle_2 = BooleanToggle(True)
distepw = DistributorEPW(EPWFilepath=panel, WriteLists=toggle_2)  # -> EPW, Latitude, Longitude, CityCountry, GHI, DNI, DHI, DryBulb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
simplepanel = SimplePanel(
    Tilt=number_slider,
    Azimuth=number_slider_2,
    DHI=distepw.DHI,
    DNI=distepw.DNI,
    Latitude=distepw.Latitude,
    Longitude=distepw.Longitude,
    Timezone=distepw.Timezone)
skydome = GHSkydome(
    RecursionLevel=number_slider_3,
    Viewfactors=toggle,
    SolarVec=False,
    HOY=0,
    Location=[distepw.Longitude, distepw.Latitude],
    DNI=distepw.DNI,
    DHI=distepw.DHI,
    Size=number_slider_4,
    Context=mesh,
    Sp=pt,
    Timezone=distepw.Timezone)  # -> Mesh, Vectors, Sunpaths, SunGeo
crv = Curve(skydome.Sunpaths)
graph = QuickGraph(simplepanel, SortOrder=0)
raw_data = Panel(simplepanel)
