# Grasshopper definition Hive_SolarThermalTimeResolvedEnergySystem.gh (Grasshopper 1.0.7)
# plug-ins: Hive.Core.solar_tech, Hive.Core.epw_reader

# ---- group: Path to weather file (.epw)
panel = Panel("C:\Users\chwaibel\Documents\GitHub\hive\GrasshopperExamples\LectureExercises\HIVE_Zurich.epw")

# ----
epwreader = EPWReader(Path=panel)  # -> Latitude, Longitude, CityCountry, GHI, DNI, DHI, DryBulb, DewPoint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
python = GhPythonScript(x="22")  # -> a
# ---------- python: Python ----------
__author__ = "chwaibel"
__version__ = "2021.05.25"

import rhinoscriptsyntax as rs

a = [x] * 8760
# ---------- end python ----------
m² = Panel("1")
panel_2 = Panel("0.6")
w_m²k = Panel("4.9")
solarthermaltimeresolved = SolarThermalTimeResolvedEnergySystem(T_in=python, T_amb=epwreader.DryBulb, OpticEff=panel_2, HeatLoss=w_m²k, Irrad=epwreader.GHI, Area=m²)  # -> flatten(Heating), Eta
panel_3 = Panel(solarthermaltimeresolved.Heating)
