# Grasshopper definition Hive_SummarizePVElectricity Yield.gh (Grasshopper 1.0.7)
# plug-ins: Hive.Core.solar_tech

# Instructions: If you don't have 8760 hourly PV generation values, you can roughly estimate them, using this equation:
# 
# Electricity Generation (on a horizontal plane) [kWh] =
# (Hourly global horizontal irradiation values [Wh/m^2] / 1000) * Typical PV module efficiency (for example, 0.15) [-] * Area [m^2]
elec_kwh = Panel("""0
0
0
0
0
0
0
0
0.0006
0.0102
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""")
list = ValueList({"Day": "day", "Month": "month", "Year": "year"}, selected="Day")
sumpvyield = SummarizePVElectricityYield(Sum_mode=list, Elec=elec_kwh)
yield_kwh = Panel(sumpvyield)
