# Grasshopper definition Hive_Form_Building_Test.gh (Grasshopper 1.0.7)
# plug-ins: HiveIO, sia380Parameters

rooms_existing = RoomsExisting({"1.1 Wohnen Mehrfamilienhaus": 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, "1.2 Wohnen Einfamilienhaus": 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, "2.1 Hotelzimmer": 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, "2.2 Empfang, Lobby": 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, "3.1 Einzel-, Gruppenbuero": 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, "3.2 Grossraumbuero": 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, "3.3 Sitzungszimmer": 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, "3.4 Schalterhalle, Empfang": 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, "4.1 Schulzimmer": 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, "4.2 Lehrerzimmer": {"description": "4.2 Lehrerzimmer", "Raumlufttemperatur Auslegung Heizen (Winter)": 21.0, "Nettogeschossflaeche": 36.0, "Thermische Gebaeudehuellflaeche": 64.0, "U-Wert Fenster": 1.5, "Waermeeintragsleistung Personen (bei 24.0 deg C, bzw. 70 W)": 23.300000000000001, "Jaehrliche Vollaststunden der Geraete": 1510.0, "U-Wert opake Bauteile": 0.80000000000000004, "Jaehrliche Vollaststunden der Raumbeleuchtung": 1030.0, "Vollaststunden pro Jahr (Personen)": 1090.0, "Abminderungsfaktor fuer Fensterrahmen": 0.75, "Aussenluft-Volumenstrom durch Infiltration": 0.29999999999999999, "Raumlufttemperatur Auslegung Kuehlung (Sommer)": 26.0, "Glasanteil": 50.0, "Zeitkonstante": 20.0, "Waermeeintragsleistung der Raumbeleuchtung": 11.6, "Waermeeintragsleistung der Geraete": 6.0, "Gesamtenergiedurchlassgrad Verglasung": 0.65000000000000002, "Temperatur-Aenderungsgrad der Waermerueckgewinnung": NaN, "Aussenluft-Volumenstrom (pro NGF)": 12.0}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}, selected="4.2 Lehrerzimmer")
rooms_standard = RoomsStandard({"1.1 Wohnen Mehrfamilienhaus": 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, "1.2 Wohnen Einfamilienhaus": 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, "2.1 Hotelzimmer": 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, "2.2 Empfang, Lobby": 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, "3.1 Einzel-, Gruppenbuero": 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, "3.2 Grossraumbuero": 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}, selected="4.4 Hoehrsaal": {"U-Wert opake Bauteile": 0.20000000000000001, "description": "4.4 Hoehrsaal", "Temperatur-Aenderungsgrad der Waermerueckgewinnung": 0.69999999999999996, "Waermeeintragsleistung Personen (bei 24.0 deg C, bzw. 70 W)": 35.0, "Jaehrliche Vollaststunden der Geraete": 1770.0, "Waermeeintragsleistung der Raumbeleuchtung": 12.5, "Emissionen transparente Bauteile": 50.0, "Emissionen opake Bauteile": 30.0, "Glasanteil": 50.0, "Raumlufttemperatur Auslegung Heizen (Winter)": 21.0, "Jaehrliche Vollaststunden der Raumbeleuchtung": 1630.0, "Kosten transparente Bauteile": 500.0, "Waermeeintragsleistung der Geraete": 4.0, "Vollaststunden pro Jahr (Personen)": 1390.0, "Gesamtenergiedurchlassgrad Verglasung": 0.5, "U-Wert Fenster": 1.2, "Thermische Gebaeudehuellflaeche": 127.0, "Zeitkonstante": 53.0, "Aussenluft-Volumenstrom (pro NGF)": 15.0, "Raumlufttemperatur Auslegung Kuehlung (Sommer)": 26.0, "Abminderungsfaktor fuer Fensterrahmen": 0.75, "Aussenluft-Volumenstrom durch Infiltration": 0.14999999999999999, "Nettogeschossflaeche": 144.0, "Kosten opake Bauteile": 300.0})
list = ValueList({"1.2 Wohnen Einfamilienhaus"}, selected="1.2 Wohnen Einfamilienhaus")
number_slider = Slider(0.25, range=0..1)
srf = Surface([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])
brep = Brep(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)
nickname = GhParametricInputSIARoom(
    Descriptiont=list,
    RoomConstant=Slider(50, range=50..300),
    CoolingSetpoint=Slider(16, range=16..30),
    HeatingSetpoint=Slider(16, range=16..30),
    FloorArea=number_slider,
    EnvelopeArea=number_slider,
    GlazingRatio=number_slider,
    UValueOpaque=number_slider,
    UValueTransparent=number_slider,
    GValue=number_slider,
    WindowFrameReduction=number_slider,
    AirChangeRate=number_slider,
    Infiltration=number_slider,
    HeatRecovery=number_slider,
    OccupantLoads=number_slider,
    LightingLoads=number_slider,
    EquipmentLoads=number_slider,
    OccupantYearlyHours=number_slider,
    LightingYearlyHours=number_slider,
    EquipmentYearlyHours=number_slider,
    OpaqueCost=number_slider,
    TransparentCost=number_slider,
    OpaqueEmissions=number_slider,
    TransparentEmissions=number_slider)
panel = Panel(nickname)
panel_2 = Panel(rooms_standard)
hive_io_bldg = HiveIOBuilding(ZoneBrepGeometries=brep, WindowsSurfaces=srf)
python = GhPythonScript(x=hive_io_bldg)  # -> out, a
# ---------- python: Python ----------
__author__ = "darthoma"
__version__ = "2020.08.24"

import rhinoscriptsyntax as rs

a = x.SIA2024.BuildingUseType
# ---------- end python ----------
panel_3 = Panel(python.a)
