# Grasshopper definition Hive_Full_Workflow.gh (Grasshopper 1.0.7)
# plug-ins: HiveIO, solar-tech, solar, heatpumps, sia380, cooling, GHSolar, epw-reader, combustion

# ---- group: Pfad zur Wetterdatei (*.epw)
# EuKS2 - Heizwärmebedarf und PV Ertrag (simuliert)
# Berechnungen zur Abschätzung des Wärmebedarfs.
# Basiert auf der Excel Tabelle "Interaktion Struktur, Klima und Wärmebedarf.xlsx"
# 
# Sonneneinstrahlung simuliert gemäss "Waibel, C., Evins, R., Carmeliet, J. 2017. Efficient time-resolved 3D solar potential modelling. Solar Energy 158 (2017) 960–976."
# C:\EnergyPlusV8-5-0\WeatherData\USA_FL_Tampa.Intl.AP.722110_TMY3.epw
panel = Panel("C:\Users\christoph\Documents\GitHub\hive\GrasshopperExamples\LectureExercises\HIVE_Zurich.epw")

# ----
hiveparainensys = ParametricInputEnergySystemsHive(
    ASHPCapacity="1000",
    ASHPCost="1000",
    ASHPEmissions="1000",
    ASHPCOP="3.5",
    NGBoilerCapacity="1000",
    NGBoilerCost="1000",
    NGBoilerEmissions="1000",
    NGBoilerEfficiency="0.95",
    CHPCapacity="1000",
    CHPCost="1000",
    CHPEmissions="1000",
    CHPHTP="1.5",
    CHPEffElec="0.3",
    ChillerCapacity="1000",
    ChillerCost="1000",
    ChillerEmissions="1000",
    ChillerCOP="3.5",
    HeatExchangerCapacity="1000",
    HeatExchangerCost="1000",
    HeatExchangerEmissions="1000",
    HeatExchangerLosses="0.05",
    CoolExchangerCapacity="1000",
    CoolExchangerCost="1000",
    CoolExchangerEmissions="1000",
    CoolExchangerLosses="0.05")

# ---- group: PV Fläche
srf = Surface(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)

# ---- group: Gebäudevolumen
brep = Brep(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)

# ---- group: Boden
mesh = Mesh(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)

# ----
mesh_uv = MeshSurface(Surface=srf, UCount="6", VCount="6", Overhang=True, Equalize=False)

# ---- group: Umgebungsbebauung
mesh_2 = Mesh([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])

# ---- group: Fensterflächen
srf_2 = Surface([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])

# ----
hiveparainemitter = ParametricInputEmitterHive(
    Vorlauf="65",
    Rücklauf="55",
    Capacity="1000",
    InvestmentCost="1000",
    EmbodiedEmissions="1000",
    Name="HeatingRadiator",
    AirEmitter=False,
    Cooling=False)
hiveparainemitter_2 = ParametricInputEmitterHive(
    Vorlauf="20",
    Rücklauf="25",
    Capacity="1000",
    InvestmentCost="1000",
    EmbodiedEmissions="1000",
    Name="AirDiffuserCool",
    AirEmitter="true",
    Cooling="true")
mesh_3 = Mesh(mesh_uv)

# ---- group: Simulate solar?
toggle = BooleanToggle(False)

# ----
hive_io_bldg = HiveIOBuilding(ZoneBrepGeometries=brep, WindowsSurfaces=srf_2)
hiveinputenergysystems = InputEnergySystemsHive(
    SolarTechProperties=mesh_uv,
    ConversionTechProperties=hiveparainensys,
    EmitterProperties=[hiveparainemitter, hiveparainemitter_2])  # -> flatten(EnergySystems)
hive_io_env = HiveIOEnvironment(EPWPath=panel, ObstaclesGeometry=[mesh, mesh_2])
hiveiodistr = HiveIODistributor(HiveInputObjects=[hive_io_env, hive_io_bldg, hiveinputenergysystems])  # -> HiveIOBuilding, HiveIOEnvironment, HiveIOEnergySystemSurfaceBasedTech, HiveIOEnergySystemConversionTech, HiveIOEnergySystemsEmitter
python = GhPythonScript(x=hiveiodistr.HiveIOBuilding)  # -> out, a
# ---------- python: Python ----------
__author__ = "Christoph"
__version__ = "2020.09.08"

import rhinoscriptsyntax as rs

print(x.Zones[0].FloorArea)
# ---------- end python ----------
nickname = GhDistributorConversionTech(HiveIOEnergySystemConversionTech=hiveiodistr.HiveIOEnergySystemConversionTech)  # -> HiveIOEnergySystemAirSourceHeatPump, HiveIOEnergySystemChiller, HiveIOEnergySystemsBoiler, HiveIOEnergySystemsCombinedHeatPowert, HiveIOEnergySystemsHeatExchanger, HiveIOEnergySystemsCoolExchanger
distrsolar = HiveIODistributorSolar(
    HiveIOBuilding=hiveiodistr.HiveIOBuilding,
    HiveIOEnergySystemSurfaceBased=hiveiodistr.HiveIOEnergySystemSurfaceBasedTech,
    HiveIOEnvironment=hiveiodistr.HiveIOEnvironment)  # -> EnvironmentMesh, BuildingCentroid, ExternalSurfaces, WindowGeometries, SolarTechMesh, WindowAzimuth, WindowAreas, SolarTechMesh_2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
hiveiodistrsupsys = HiveIODistributorSupplySystem(HiveIOEnergySystemsSurfaceBased=hiveiodistr.HiveIOEnergySystemSurfaceBasedTech)  # -> EfficiencyPV, PVAreas, EfficiencyST, STAreas, ElectricEfficiencyPVT, ThermalEfficiencyPVT, PVTAreas
hivedistenvironment = DistributorEnvironmentHive(HiveIOEnvironment=hiveiodistr.HiveIOEnvironment)  # -> Filepath, NaturalGas, BioGas, WoodPellets, DistrictHeating, DistrictCooling, GridElectricity, AmbientAirTemp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
distributorsia = DistributorSIA(BuildingObj=hiveiodistr.HiveIOBuilding)  # -> ZoneAreas, WindowsAreas, ExtSrfAreas, SIA2024json
epw_reader = EPWReader(Path=hivedistenvironment.Filepath)  # -> Latitude, Longitude, CityCountry, GHI, DNI, DHI, DryBulb, DewPoint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
python_2 = GhPythonScript(x=distrsolar.WindowGeometries, y=toggle)  # -> out, a
# ---------- python_2: Python ----------
__author__ = "chwaibel"
__version__ = "2020.09.09"

import rhinoscriptsyntax as rs

if y:
    a = x
# ---------- end python_2 ----------
sia2024 = SIA2024Rooms(
    Room=distributorsia.SIA2024json,
    Area=distributorsia.ZoneAreas,
    Month=[1, 2, 3, 4, 5, 6, 7, 8, 9, 10, 11, 12],
    Season="winter")  # -> Τ_h, Θ_i_C, T_h, A_op_m2, A_w_m2, U_op_W_m2K, U_w_W_m2K, V_e_m3_h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
python_3 = GhPythonScript(x=distrsolar.SolarTechMesh_2, y=toggle)  # -> out, a; same code as python_2
adaptcomf = AdaptiveComfort(T_m=epw_reader.DryBulbMonthly)  # -> T_n, T_n80ub, T_n80lb, T_n90ub, T_n90lb
data = Data([0.8, 0.8, 0.8, 0.8, 0.8, 0.8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])
mesh_4 = Mesh(distrsolar.ExternalSurfaces)
obstobj = ObstacleObject(Mesh=[distrsolar.EnvironmentMesh, mesh_4], Albedo=data, SpecCoeff=data, ReflType=0, Tolerance=0.01, Name="PV", MT=True)

# ----
# Solare Wärmeeinträge (shaded)
mesh_5 = MeshBrep(
    Brep=python_2.a,
    Settings={GridMaxCount=0, GridMinCount=16, JaggedSeams=False, MaxEdgeLength=0, MinEdgeLength=0.0001, MinTolerance=0, Refine=True, RefineAngle=0, RelativeTolerance=0.65, SimplePlanes=True, Tolerance=0})
obstobj_2 = ObstacleObject(Mesh=mesh_5, Albedo=data, SpecCoeff=data, ReflType=0, Tolerance=0.01, Name="PV", MT=True)
irrmshy = IrradiationMeshYear(
    AnalysisObjects=obstobj_2,
    ObstacleObjects=obstobj,
    Latitude=epw_reader.Latitude,
    Longitude=epw_reader.Longitude,
    Year=2017,
    DNI=epw_reader.DNI,
    DHI=epw_reader.DHI,
    MainSkyRes=1,
    SpecBounces=0,
    DiffIReflSkyRes=0,
    DiffIReflMode=2,
    MT=True)
readresults = ReadResults(Mesh=mesh_5, I=irrmshy, Value=7)  # -> simplify(Results), SP
python_4 = GhPythonScript(x=simplify(readresults.Results), month=[0, 1, 2, 3, 4, 5, 6, 7, 8, 9, 10, 11])  # -> out, a; inputs x: list, month: Int32
# ---------- python_4: Python ----------
__author__ = "chwaibel"
__version__ = "2020.02.25"

import rhinoscriptsyntax as rs

# 8760 time series
# get monthly average...
# how to know how many days a month? somewhere, I have typical year.
# in some honey-badger script
if not x:
    a = None
else:
    a = runit()

print(not x)

def runit():
    dayspermonth = [31.0, 28.0, 31.0, 30.0, 31.0, 30.0, 31.0, 31.0, 30.0, 31.0, 30.0, 31.0]
    
    hour_per_day = 24
    start_hour = int(hour_per_day * sum(dayspermonth[0:month])) 
    end_hour = int(hour_per_day * sum(dayspermonth[0:month+1]))
    
    cumulative_data = sum(x[start_hour:end_hour])
    
    a = cumulative_data / 1000
    return a
# ---------- end python_4 ----------
visumshsol = VisualizeMeshSolar(Mesh=mesh_5, I=irrmshy, Value=0)

item = ListItem(List=sia2024.G_, Index=0, Wrap=True)

# ----
# SOLAR SIMULATION
# Solare Wärmeeinträge (unshaded)
simplepanel = SimplePanel(
    Tilt=distrsolar.SolarTechMesh,
    Azimuth=distrsolar.WindowAzimuth,
    DHI=epw_reader.DHI,
    DNI=epw_reader.DNI,
    Latitude=epw_reader.Latitude,
    Longitude=epw_reader.Longitude,
    Aw=distrsolar.WindowAreas)
python_5 = GhPythonScript(x=simplify(simplepanel), month=[0, 1, 2, 3, 4, 5, 6, 7, 8, 9, 10, 11])  # -> out, a; inputs x: list, month: Int32
# ---------- python_5: Python ----------
__author__ = "chwaibel"
__version__ = "2020.02.25"

import rhinoscriptsyntax as rs

# 8760 time series
# get monthly average...
# how to know how many days a month? somewhere, I have typical year.
# in some honey-badger script

dayspermonth = [31.0, 28.0, 31.0, 30.0, 31.0, 30.0, 31.0, 31.0, 30.0, 31.0, 30.0, 31.0]

hour_per_day = 24
start_hour = int(hour_per_day * sum(dayspermonth[0:month])) 
end_hour = int(hour_per_day * sum(dayspermonth[0:month+1]))

cumulative_data = sum(x[start_hour:end_hour])

a = cumulative_data / 1000
# ---------- end python_5 ----------

# ---- group: obstructed
c_script = CSharpScript(G=python_4.a, g=item)  # -> out, Q_s; inputs G: tree of Double, g: Double
# ---------- c_script: C# ----------
    int winCount = G.BranchCount;
    double [][] Q_array = new double[12][];
    for(int j = 0; j < G.Branch(0).Count; j++)
      Q_array[j] = new double[G.BranchCount];

    DataTree<double> doubleTree = new DataTree<double>();
    for (int i = 0; i < G.BranchCount; i++)
    {
      for (int j = 0; j < G.Branch(i).Count; ++j) // should be 12, 1 for each month of the year
      {
        GH_Path path = new GH_Path(i, j);
        double irrad = G.Branch(i)[j] * g;
        doubleTree.Add(irrad, path);

        Q_array[j][i] = irrad*1000;
      }
    }
    jagged jag = new jagged();
    jag.data = Q_array;

    Q_s = jag;
# ---------- c_script: C# additional code ----------
  public struct jagged
  {
    public double [][] data;
  }
# ---------- end c_script ----------
python_6 = GhPythonScript(x=c_script.Q_s, y=toggle)  # -> out, a
# ---------- python_6: Python ----------
__author__ = "chwaibel"
__version__ = "2020.09.09"

import rhinoscriptsyntax as rs

if y:
    a = x
else:
    a = None
# ---------- end python_6 ----------

# ---- group: unobstructed
c_script_2 = CSharpScript(G=python_5.a, g=item)  # -> out, Q_s; inputs G: tree of Double, g: Double; same code as c_script

# ---- group: NEW SIA 380 COMPONENT
# DEMAND MODELING
subtraction = Subtraction(A=distributorsia.ExtSrfAreas, B=distributorsia.WindowsAreas)
python_7 = GhPythonScript(transparent=distrsolar.WindowAreas, opaque=subtraction)  # -> out, flatten(a); inputs transparent: list, opaque: list
# ---------- python_7: Python ----------
__author__ = "Christoph"
__version__ = "2020.09.12"

import rhinoscriptsyntax as rs

a = []
for trans in transparent:
    a.append("transp")
    
for op in opaque:
    a.append("opaque")
# ---------- end python_7 ----------
merge = Merge(Data1=distrsolar.WindowAreas, Data2=subtraction)  # -> flatten(Result)
panel_2 = Panel(python_7.a)
sia380 = SIA380(
    Room_properties=distributorsia.SIA2024json,
    Floor_area=distributorsia.ZoneAreas,
    T_e=epw_reader.DryBulbMonthly,
    Setpoints_ub=adaptcomf.T_n90ub,
    Setpoints_lb=adaptcomf.T_n90lb,
    Surface_areas=merge,
    Surface_type=panel_2,
    Q_s_per_surface=python_6.a,
    Q_s_per_surfaceUnobstructed=c_script_2.Q_s)  # -> Q_Heat, Q_Cool, Q_Elec, Q_T, Q_V, Q_i, Q_s
ma = MassAddition(Input=sia380.Q_Heat)  # -> Result, PartialResults
division = Division(A=ma.Result, B=distributorsia.ZoneAreas)

# ----
panel_3 = Panel(python_4.a)
abs = Absolute(Value=sia380.Q_Cool)

# ----
# PV Ertrag (simuliert)
obstobj_3 = ObstacleObject(Mesh=python_3.a, Albedo=data, SpecCoeff=data, ReflType=0, Tolerance=0.01, Name="PV", MT=True)
irrmshy_2 = IrradiationMeshYear(
    AnalysisObjects=obstobj_3,
    ObstacleObjects=obstobj,
    Latitude=epw_reader.Latitude,
    Longitude=epw_reader.Longitude,
    Year=2017,
    DNI=epw_reader.DNI,
    DHI=epw_reader.DHI,
    MainSkyRes=1,
    SpecBounces=0,
    DiffIReflSkyRes=0,
    DiffIReflMode=2,
    MT=True)
readresults_2 = ReadResults(Mesh=distrsolar.SolarTechMesh_2, I=irrmshy_2, Value=7)  # -> Results, SP
python_8 = GhPythonScript(x=simplify(readresults_2.Results), month=[0, 1, 2, 3, 4, 5, 6, 7, 8, 9, 10, 11])  # -> out, a; inputs x: list, month: Int32; same code as python_5
visumshsol_2 = VisualizeMeshSolar(Mesh=distrsolar.SolarTechMesh_2, I=irrmshy_2, Value=0)
c_script_3 = CSharpScript(G=python_8.a, g=hiveiodistrsupsys.EfficiencyPV)  # -> out, Q_s; inputs G: tree of Double, g: list of Double
# ---------- c_script_3: C# ----------
    int winCount = G.BranchCount;
    double [] Q_array = new double[12];

    DataTree<double> doubleTree = new DataTree<double>();
    for (int i = 0; i < G.BranchCount; i++)
    {
      for (int j = 0; j < G.Branch(i).Count; ++j) // should be 12, 1 for each month of the year
      {
        GH_Path path = new GH_Path(i, j);
        double irrad = G.Branch(i)[j]  * g[i];
        doubleTree.Add(irrad, path);

        Q_array[j] += irrad;
      }
    }

    Q_s = Q_array;
# ---------- end c_script_3 ----------
ma_2 = MassAddition(Input=c_script_3.Q_s)  # -> Result, PartialResults
ma_3 = MassAddition(Input=hiveiodistrsupsys.PVAreas)  # -> Result, PartialResults
division_2 = Division(A=ma_2.Result, B=ma_3.Result)

# ----
# PV Ertrag (unverschattet)
# Q_s = G * F_F * A_w * g
# [Q_s] = kWh
# [G] = kWh/m^2
# [F_F] = -
# [A_w] = m^2
# [g] = -
simplepanel_2 = SimplePanel(
    Tilt=distrsolar.SolarTechTilt,
    Azimuth=distrsolar.SolarTechAzimuth,
    DHI=epw_reader.DHI,
    DNI=epw_reader.DNI,
    Latitude=epw_reader.Latitude,
    Longitude=epw_reader.Longitude)

# ----
# EHub Parameters
python_9 = GhPythonScript(emitters=hiveiodistr.HiveIOEnergySystemsEmitter)  # -> out, monthlyHeatingSupTemp, monthlyCoolingSupTemp, heatingCarrier, monthlyHeatingReturnTemp, yearlyHeatingSupTemp, yearlyHeatingReturnTemp, monthlyCoolingReturnTemp; inputs emitters: list
# ---------- python_9: Python ----------
__author__ = "chwaibel"
__version__ = "2020.08.20"

import rhinoscriptsyntax as rs

for e in emitters:
    if e.IsCooling:
        monthlyCoolingSupTemp = e.InletCarrier.MonthlyTemperature
        monthlyCoolingReturnTemp = e.ReturnCarrier.MonthlyTemperature
    else:
        monthlyHeatingSupTemp = e.InletCarrier.MonthlyTemperature
        heatingCarrier = e
        monthlyHeatingReturnTemp = e.ReturnCarrier.MonthlyTemperature
        yearlyHeatingSupTemp = e.InletCarrier.Temperature
        yearlyHeatingReturnTemp = e.ReturnCarrier.Temperature
# ---------- end python_9 ----------
gas_price_chf_kwh = Panel("0.209")
emission_factor_electricity_kgco2_kwh = Panel("0.209")
emission_factor_natural_gas_kgco2_kwh = Panel("0.27")
cost_electricity_chf_kwh = Panel("0.27")
# Energy Hub
horizon = Panel("12")

# ----
# PV / ST
panel_4 = Panel("hourly")
# deprecated
solartechsetoutputs = SolarTechSetOutputs(
    GHSolar_CResults=irrmshy_2,
    Hive_SurfaceBased=hiveiodistr.HiveIOEnergySystemSurfaceBasedTech,
    Amb_T_carrier=epw_reader.AmbientTemperatureCarrier,
    Return_water_carrier=python_9.heatingCarrier,
    TimeResolution=panel_4)
python_10 = GhPythonScript(solarTech=solartechsetoutputs)  # -> out, pvHourly, pvMonthly, solarPot, inletWater, ambientAir, panelArea
# ---------- python_10: Python ----------
__author__ = "Christoph"
__version__ = "2020.07.06"

import rhinoscriptsyntax as rs

import Hive.IO.EnergySystems as ensys

pvHourly = solarTech.OutputCarriers[0].Energy

pvMonthly = solarTech.OutputCarriers[0].MonthlyCumulativeEnergy

solarPot = solarTech.InputCarrier.Energy
if isinstance(solarTech, ensys.SolarThermal):
    inletWater = solarTech.InletWater.SupplyTemperature
ambientAir = solarTech.AmbientAir.Temperature
panelArea = solarTech.SurfaceArea
# ---------- end python_10 ----------
graph = QuickGraph(python_10.pvMonthly, SortOrder=0)
python_11 = GhPythonScript(x=irrmshy_2)  # -> out, a
# ---------- python_11: Python ----------
__author__ = "chwaibel"
__version__ = "2020.08.21"

import rhinoscriptsyntax as rs

a = x.I_hourly
# ---------- end python_11 ----------
hivemergersolartech = MergerSolarTechHive(
    I_hourlyM=python_11.a,
    SolarTech=hiveiodistr.HiveIOEnergySystemSurfaceBasedTech,
    Air=hivedistenvironment.AmbientAirTemp,
    SupplyTemp=python_9.yearlyHeatingSupTemp,
    ReturnTemp=python_9.yearlyHeatingReturnTemp,
    SimpleMode=Toggle(False),
    I_hourly=simplepanel_2)
python_12 = GhPythonScript(x=hivemergersolartech)  # -> out, a
# ---------- python_12: Python ----------
__author__ = "chwaibel"
__version__ = "2020.08.24"

import rhinoscriptsyntax as rs
a = x.OutputCarriers[0].MonthlyCumulativeEnergy
# ---------- end python_12 ----------
panel_5 = Panel(hivemergersolartech)
graph_2 = QuickGraph(python_12.a, SortOrder=0)
ma_4 = MassAddition(Input=python_12.a)  # -> Result, PartialResults
panel_6 = Panel(ma_4.Result)

# ----
# Heat Exchanger for District Heating
hivemergerhx = MergerHeatExchangerHive(
    DistrictHeating=hivedistenvironment.DistrictHeating,
    HeatDemand=sia380.Q_Heat,
    SuppTemp=python_9.monthlyHeatingSupTemp,
    ReturnTemp=python_9.monthlyHeatingReturnTemp,
    HeatExchanger=nickname.HiveIOEnergySystemsHeatExchanger)
panel_7 = Panel(hivemergerhx)

# ----
# CHP
# deprecated
panel_8 = Panel("0.3")
chp = Chp(
    Loads=sia380.Q_Heat,
    Eta=panel_8,
    Htp="1.5",
    Fuelcost=gas_price_chf_kwh,
    Fuelemissions=emission_factor_natural_gas_kgco2_kwh)  # -> Gas_consumed, Total_cost, Total_emissions, Heating_gen, Elec_gen
python_13 = GhPythonScript(gasConsumed=chp.Gas_consumed, EF=emission_factor_natural_gas_kgco2_kwh, price=gas_price_chf_kwh)  # -> out, GasCarrier, ghg, cost; inputs gasConsumed: list
# ---------- python_13: Python ----------
__author__ = "Christoph"
__version__ = "2020.08.06"
from System import Array
import rhinoscriptsyntax as rs
import Hive.IO.EnergySystems as hive

energyCost = [i * price for i in gasConsumed]
ghgEmissions = [i * EF for i in gasConsumed]

GasCarrier = hive.Gas(gasConsumed.Count, Array[float](gasConsumed), Array[float](energyCost), Array[float](ghgEmissions))
ghg = ghgEmissions
cost = energyCost
# ---------- end python_13 ----------
hivemergerchp = MergerCHPHive(
    Gas=hivedistenvironment.NaturalGas,
    EnergyDemand=sia380.Q_Elec,
    IsHeatingDemand=False,
    SuppTemp=python_9.monthlyHeatingSupTemp,
    HiveIOCombinedHeatPower=nickname.HiveIOEnergySystemsCombinedHeatPowert)
panel_9 = Panel(hivemergerchp)

# ----
# Air Source Heat Pump
# deprecated
cop_ashp = Panel("3.5")
simple_hp = SimpleHp(Q_th=sia380.Q_Heat, COP=cop_ashp)
ma_5 = MassAddition(Input=simple_hp)  # -> Result, PartialResults
python_14 = GhPythonScript(electricityConsumed=simple_hp, EF=emission_factor_electricity_kgco2_kwh, price=cost_electricity_chf_kwh)  # -> out, ElectricityCarrier, ghg, cost; inputs electricityConsumed: list
# ---------- python_14: Python ----------
__author__ = "Christoph"
__version__ = "2020.08.06"
from System import Array
import rhinoscriptsyntax as rs
import Hive.IO.EnergySystems as hive

energyCost = [i * price for i in electricityConsumed]
ghgEmissions = [i * EF for i in electricityConsumed]

ElectricityCarrier = hive.Electricity(electricityConsumed.Count, Array[float](electricityConsumed), Array[float](energyCost), Array[float](ghgEmissions))
ghg = ghgEmissions
cost = energyCost
# ---------- end python_14 ----------
division_3 = Division(A=ma_5.Result, B=distributorsia.ZoneAreas)
hivemergerashp = MergerAirSourceHeatPumpHive(
    Air=hivedistenvironment.AmbientAirTemp,
    Electricity=hivedistenvironment.GridElectricity,
    HeatGenerated=sia380.Q_Heat,
    SuppTemp=python_9.monthlyHeatingSupTemp,
    ReturnTemp=python_9.monthlyHeatingReturnTemp,
    SimpleMode=Toggle(False),
    ASHP=nickname.HiveIOEnergySystemAirSourceHeatPump)
panel_10 = Panel(hivemergerashp)

# ----
# Heat Exchanger for District Cooling
hivemergercx = MergerCoolingExchangerHive(
    DistrictCooling=hivedistenvironment.DistrictCooling,
    CoolDemand=abs,
    SuppTemp=python_9.monthlyCoolingSupTemp,
    ReturnTemp=python_9.monthlyCoolingReturnTemp,
    CoolingExchanger=nickname.HiveIOEnergySystemsCoolExchanger)
panel_11 = Panel(hivemergercx)

# ----
# Chiller
# deprecated
python_15 = GhPythonScript(emissionFactor=emission_factor_electricity_kgco2_kwh)  # -> out, emissionTimeseries
# ---------- python_15: Python ----------
__author__ = "chwaibel"
__version__ = "2020.08.12"

import rhinoscriptsyntax as rs

horizon = 12

emissionTimeseries = [emissionFactor] * horizon
# ---------- end python_15 ----------
python_16 = GhPythonScript(airCarrier=epw_reader.AmbientTemperatureCarrier)  # -> out, airTemperature
# ---------- python_16: Python ----------
__author__ = "chwaibel"
__version__ = "2020.08.12"

import rhinoscriptsyntax as rs

airTemperature = airCarrier.Temperature
# ---------- end python_16 ----------
python_17 = GhPythonScript(elecPrice=cost_electricity_chf_kwh)  # -> out, elecTimeseries
# ---------- python_17: Python ----------
__author__ = "chwaibel"
__version__ = "2020.08.12"

import rhinoscriptsyntax as rs

horizon = 12

elecTimeseries = [elecPrice] * horizon
# ---------- end python_17 ----------
chiller_tr = ChillerTr(
    Cooling_loads=abs,
    Elec_cost=python_17.elecTimeseries,
    Elec_emissions=python_15.emissionTimeseries,
    Temperature=python_16.airTemperature)  # -> Elec, Cost, Carbon, COP
python_18 = GhPythonScript(electricityConsumed=chiller_tr.Elec, EF=emission_factor_electricity_kgco2_kwh, price=cost_electricity_chf_kwh)  # -> out, ElectricityCarrier, ghg, cost; inputs electricityConsumed: list; same code as python_14
addition = Addition(A=python_9.monthlyCoolingSupTemp, B="5")
hivemergerchiller = MergerChillerHive(
    Air=hivedistenvironment.AmbientAirTemp,
    Electricity=hivedistenvironment.GridElectricity,
    CoolingGenerated=abs,
    SuppTemp=python_9.monthlyCoolingSupTemp,
    ReturnTemp=addition,
    SimpleMode=Toggle(False),
    Chiller=nickname.HiveIOEnergySystemChiller)
panel_12 = Panel(hivemergerchiller)

# ----
# Electrical Substation
hivemergergrid = MergerGridSubstationHive()

# ----
# Gas Boiler
# deprecated
boiler_efficiency = Panel("0.95")
boiler = Boiler(
    Heating_loads=sia380.Q_Heat,
    Carrier_cost=gas_price_chf_kwh,
    Carrier_emissions=emission_factor_natural_gas_kgco2_kwh,
    Efficiency=boiler_efficiency)  # -> Gas_consumed, Cost, Carbon
python_19 = GhPythonScript(gasConsumed=boiler.Gas_consumed, EF=emission_factor_natural_gas_kgco2_kwh, price=gas_price_chf_kwh)  # -> out, GasCarrier, ghg, cost; inputs gasConsumed: list; same code as python_13
hivemergerboiler = MergerGasBoilerHive(
    Gas=hivedistenvironment.NaturalGas,
    HeatDemand=sia380.Q_Heat,
    SuppTemp=python_9.monthlyHeatingSupTemp,
    HiveIOGasBoiler=nickname.HiveIOEnergySystemsBoiler)
panel_13 = Panel(hivemergerboiler)

# ----
# Plug-in any conversion tech
python_20 = GhPythonScript(x=hivemergerchiller)  # -> out, description
# ---------- python_20: Python ----------
__author__ = "chwaibel"
__version__ = "2020.08.18"

import rhinoscriptsyntax as rs

a = ("total investment cost: ", x.SpecificInvestmentCost * x.Capacity)
b = ("capacity: ", x.Capacity)
c = ("cap unit; ", x.CapacityUnit)
d = ("name: ", x.Name)
e = ("opCost CHF/a: ", sum(x.InputCarrier.TotalEnergyCost))
f = ("totEnergy kWh/a: ", sum(x.InputCarrier.Energy))
description = [a, b, c, d, e, f]

# print(x.InputCarrier.MonthlyCumulativeEnergy)
print(x.OutputCarriers[0].Energy)
# ---------- end python_20 ----------
panel_14 = Panel(python_20.description)

# ----
# Results
data_2 = Data([ma.Result, ma_5.Result, ma_2.Result, division, division_3, division_2])
hiveresults = ResultsHive(
    CoolingMonthly=abs,
    HeatingMonthly=sia380.Q_Heat,
    ElectricityMonthly=sia380.Q_Elec,
    HiveBuilding=hiveiodistr.HiveIOBuilding,
    HiveConversionTech=[hivemergerchiller, hivemergerashp],
    Q_T=sia380.Q_T,
    Q_V=sia380.Q_V,
    Q_i=sia380.Q_i,
    Q_s=sia380.Q_s)
hive_io_visualizer = HiveIOVisualizer(hiveresults)

# ---- group: Heizwärmebedarf, Strombedarf Wärmepumpe und Stromertrag PV
# Jahresheizwärmebedarf in kWh
# Jahresstrombedarf Wärmepumpe in kWh
# Jahresstromertrag PV in kWh
# Jahresheizwärmebedarf in kWh/m^2
# Jahresstrombedarf Wärmepumpe in kWh/m^2
# Jahresstromertrag PV in kWh/m^2 PV
panel_15 = Panel(data_2)
