# Grasshopper definition Hive_Hidden_Core.gh (Grasshopper 1.0.7)
# plug-ins: HiveIO, solar, sia380, GHSolar, epw-reader

panel = Panel("C:\Users\Christoph\Documents\GitHub\hive\GrasshopperExamples\LectureExercises\HIVE_Geneva.epw")

# ---- group: Path to weather file (.epw)
panel_2 = Panel("C:\EnergyPlusV9-3-0\WeatherData\USA_CA_San.Francisco.Intl.AP.724940_TMY3.epw")

# ---- group: PV Surface
srf = Surface(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)

# ---- group: discretization in U and V
panel_3 = Panel("6")

# ----
mesh_uv = MeshSurface(Surface=srf, UCount=panel_3, VCount=panel_3, Overhang=True, Equalize=False)

# ---- group: Ground
mesh = Mesh(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)

# ---- group: Context (City, obstacles, etc.)
mesh_2 = Mesh([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])

# ---- group: Building volume
brep = Brep(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)

# ---- group: Windows
srf_2 = Surface([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])

# ---- group: Hive model description
hiveinputenergysystems = InputEnergySystemsHive(SolarTechProperties=mesh_uv)  # -> flatten(EnergySystems)
hiveinputbuilding = InputBuildingHive(ZoneBrepGeometries=brep, WindowsSurfaces=srf_2)
hive_io_env = HiveIOEnvironment(EPWPath=panel_2, ObstaclesGeometry=[mesh, mesh_2])

# ----
hiveiodistr = HiveIODistributor(HiveInputObjects=[hive_io_env, hiveinputbuilding, hiveinputenergysystems])  # -> HiveIOBuilding, HiveIOEnvironment, HiveIOEnergySystemSurfaceBasedTech, HiveIOEnergySystemConversionTech, HiveIOEnergySystemsEmitter

# ---- group: shading mask rec level
number_slider = Slider(3, range=0..5)
number_slider_2 = Slider(0.089, range=0..2)
toggle = BooleanToggle(False)

# ---- group: sun vector HOY
number_slider_3 = Slider(2680, range=0..8759)
toggle_2 = BooleanToggle(False)

# ---- group: show sunpath
toggle_3 = BooleanToggle(True)

# ---- group: Simulate solar?
toggle_4 = BooleanToggle(True)

# ---- group: Simple efficiency calculations?
toggle_5 = BooleanToggle(False)

# ----
# Distributor
hivedistenvironment = DistributorEnvironmentHive(HiveIOEnvironment=hiveiodistr.HiveIOEnvironment)  # -> Filepath, NaturalGas, BioGas, WoodPellets, DistrictHeating, DistrictCooling, GridElectricity, AmbientAirTemp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
distributorsia = DistributorSIA(BuildingObj=hiveiodistr.HiveIOBuilding)  # -> ZoneAreas, WindowsAreas, ExtSrfAreas, SIA2024json, AllExtSrfAreas, SurfaceType
hiveiodistrsupsys = HiveIODistributorSupplySystem(HiveIOEnergySystemsSurfaceBased=hiveiodistr.HiveIOEnergySystemSurfaceBasedTech)  # -> EfficiencyPV, PVAreas, EfficiencyST, STAreas, ElectricEfficiencyPVT, ThermalEfficiencyPVT, PVTAreas
distrsolar = HiveIODistributorSolar(
    HiveIOBuilding=hiveiodistr.HiveIOBuilding,
    HiveIOEnergySystemSurfaceBased=hiveiodistr.HiveIOEnergySystemSurfaceBasedTech,
    HiveIOEnvironment=hiveiodistr.HiveIOEnvironment)  # -> EnvironmentMesh, BuildingCentroid, ExternalSurfaces, WindowGeometries, SolarTechMesh, WindowAzimuth, WindowAreas, SolarTechMesh_2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
nickname = GhDistributorConversionTech(HiveIOEnergySystemConversionTech=hiveiodistr.HiveIOEnergySystemConversionTech)  # -> HiveIOEnergySystemAirSourceHeatPump, HiveIOEnergySystemChiller, HiveIOEnergySystemsBoiler, HiveIOEnergySystemsCombinedHeatPowert, HiveIOEnergySystemsHeatExchanger, HiveIOEnergySystemsCoolExchanger, HiveIOEnergySystemElectricalSubstation
bool = Boolean(toggle_4)
epw_reader = EPWReader(Path=hivedistenvironment.Filepath)  # -> Latitude, Longitude, CityCountry, GHI, DNI, DHI, DryBulb, DewPoint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
sia2024room = SIA2024RoomReader(Room=distributorsia.SIA2024json, Area=distributorsia.ZoneAreas)  # -> Τ_h, Θ_i_C, T_h, A_op_m2, A_w_m2, U_op_W_m2K, U_w_W_m2K, V_e_m3_h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
python = GhPythonScript(x=distrsolar.WindowGeometries, y=bool)  # -> out, a
# ---------- python: Python ----------
__author__ = "chwaibel"
__version__ = "2020.09.09"

import rhinoscriptsyntax as rs

if y:
    a = x
# ---------- end python ----------
python_2 = GhPythonScript(x=distrsolar.SolarTechMesh_2, y=bool)  # -> out, a; same code as python
adaptcomf = AdaptiveComfort(T_m=epw_reader.DryBulbMonthly)  # -> T_n, T_n80ub, T_n80lb, T_n90ub, T_n90lb

# ---- group: DHI
data = Data(epw_reader.DHI)

# ----
# Shading Mask
dni = Data(epw_reader.DNI)
panel_4 = Panel([epw_reader.Longitude, epw_reader.Latitude])
pt = Point(distrsolar.BuildingCentroid)
skydome = GHSkydome(
    RecursionLevel=number_slider,
    Viewfactors=toggle,
    CumSkyMatrix=Toggle(False),
    SunPath=toggle_3,
    SolarVec=toggle_2,
    HOY=number_slider_3,
    Location=panel_4,
    DNI=dni,
    DHI=data,
    Size=number_slider_2,
    Context=distrsolar.EnvironmentMesh,
    Sp=pt)  # -> Mesh, Vectors, Sunpaths, SunGeo

# ----
# SOLAR SIMULATION
mesh_3 = Mesh(distrsolar.ExternalSurfaces)
data_2 = Data([0.8, 0.8, 0.8, 0.8, 0.8, 0.8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])
obstobj = ObstacleObject(
    Mesh=[distrsolar.EnvironmentMesh, mesh_3],
    Albedo=data_2,
    SpecCoeff=data_2,
    ReflType=0,
    Tolerance=0.01,
    Name="PV",
    MT=True)

# ----
# Solare Wärmeeinträge (shaded)
mesh_4 = MeshBrep(
    Brep=python.a,
    Settings={GridMaxCount=0, GridMinCount=16, JaggedSeams=False, MaxEdgeLength=0, MinEdgeLength=0.0001, MinTolerance=0, Refine=True, RefineAngle=0, RelativeTolerance=0.65, SimplePlanes=True, Tolerance=0})
obstobj_2 = ObstacleObject(Mesh=mesh_4, Albedo=data_2, SpecCoeff=data_2, ReflType=0, Tolerance=0.01, Name="PV", MT=True)
irrmshy = IrradiationMeshYear(
    AnalysisObjects=obstobj_2,
    ObstacleObjects=obstobj,
    Latitude=epw_reader.Latitude,
    Longitude=epw_reader.Longitude,
    Year=2017,
    DNI=epw_reader.DNI,
    DHI=epw_reader.DHI,
    MainSkyRes=1,
    SpecBounces=0,
    DiffIReflSkyRes=0,
    DiffIReflMode=2,
    MT=True)
readresults = ReadResults(Mesh=mesh_4, I=irrmshy, Value=7)  # -> simplify(Results), SP
visumshsol = VisualizeMeshSolar(Mesh=mesh_4, I=irrmshy, Value=0)

python_3 = GhPythonScript()  # -> out, a
# ---------- python_3: Python ----------
__author__ = "Christoph"
__version__ = "2020.10.12"

import rhinoscriptsyntax as rs
a = range(0,8759)
# ---------- end python_3 ----------
item = TreeItem(Tree=readresults.Results, Path="0", Index=python_3.a, Wrap=True)

# ----
# Solare Wärmeeinträge (unshaded)
simplepanel = SimplePanel(
    Tilt=distrsolar.SolarTechMesh,
    Azimuth=distrsolar.WindowAzimuth,
    DHI=epw_reader.DHI,
    DNI=epw_reader.DNI,
    Latitude=epw_reader.Latitude,
    Longitude=epw_reader.Longitude,
    Aw=distrsolar.WindowAreas)

item_2 = TreeItem(Tree=simplepanel, Path="0;0;0", Index=python_3.a, Wrap=True)
graph = QuickGraph(item, SortOrder=0)

# ---- group: NEW SIA 380 COMPONENT
# DEMAND
sia380 = SIA380(
    Room_properties=distributorsia.SIA2024json,
    Floor_area=distributorsia.ZoneAreas,
    T_e=epw_reader.DryBulbMonthly,
    Setpoints_ub=adaptcomf.T_n90ub,
    Setpoints_lb=adaptcomf.T_n90lb,
    Surface_areas=distributorsia.AllExtSrfAreas,
    Surface_type=distributorsia.SurfaceType,
    Q_s_tree=readresults.Results,
    Q_s_tree_unobstructed=simplepanel,
    G_value=sia2024room.G_,
    G_value_total=sia2024room.G_total_,
    Setpoint=sia2024room.G_T_W_m_2,
    Run_obstr=bool)  # -> Q_Heat, Q_Cool, Q_Elec, Q_T, Q_V, Q_i, Q_s, Q_T_opaque, Q_T_transparent, Q_s_per_windows
abs = Absolute(Value=sia380.Q_Cool)
ma = MassAddition(Input=sia380.Q_Heat)  # -> Result, PartialResults
division = Division(A=ma.Result, B=distributorsia.ZoneAreas)

# ----
# PV Ertrag (simuliert)
obstobj_3 = ObstacleObject(Mesh=python_2.a, Albedo=data_2, SpecCoeff=data_2, ReflType=0, Tolerance=0.01, Name="PV", MT=True)
irrmshy_2 = IrradiationMeshYear(
    AnalysisObjects=obstobj_3,
    ObstacleObjects=obstobj,
    Latitude=epw_reader.Latitude,
    Longitude=epw_reader.Longitude,
    Year=2017,
    DNI=epw_reader.DNI,
    DHI=epw_reader.DHI,
    MainSkyRes=1,
    SpecBounces=0,
    DiffIReflSkyRes=0,
    DiffIReflMode=2,
    MT=True)
readresults_2 = ReadResults(Mesh=distrsolar.SolarTechMesh_2, I=irrmshy_2, Value=7)  # -> Results, SP
python_4 = GhPythonScript(x=simplify(readresults_2.Results), month=[0, 1, 2, 3, 4, 5, 6, 7, 8, 9, 10, 11])  # -> out, a; inputs x: list, month: Int32
# ---------- python_4: Python ----------
__author__ = "chwaibel"
__version__ = "2020.02.25"

import rhinoscriptsyntax as rs

# 8760 time series
# get monthly average...
# how to know how many days a month? somewhere, I have typical year.
# in some honey-badger script

dayspermonth = [31.0, 28.0, 31.0, 30.0, 31.0, 30.0, 31.0, 31.0, 30.0, 31.0, 30.0, 31.0]

hour_per_day = 24
start_hour = int(hour_per_day * sum(dayspermonth[0:month])) 
end_hour = int(hour_per_day * sum(dayspermonth[0:month+1]))

cumulative_data = sum(x[start_hour:end_hour])

a = cumulative_data / 1000
# ---------- end python_4 ----------
visumshsol_2 = VisualizeMeshSolar(Mesh=distrsolar.SolarTechMesh_2, I=irrmshy_2, Value=0)
c_script = CSharpScript(G=python_4.a, g=hiveiodistrsupsys.EfficiencyPV)  # -> out, Q_s; inputs G: tree of Double, g: list of Double
# ---------- c_script: C# ----------
    int winCount = G.BranchCount;
    double [] Q_array = new double[12];

    DataTree<double> doubleTree = new DataTree<double>();
    for (int i = 0; i < G.BranchCount; i++)
    {
      for (int j = 0; j < G.Branch(i).Count; ++j) // should be 12, 1 for each month of the year
      {
        GH_Path path = new GH_Path(i, j);
        double irrad = G.Branch(i)[j]  * g[i];
        doubleTree.Add(irrad, path);

        Q_array[j] += irrad;
      }
    }

    Q_s = Q_array;
# ---------- end c_script ----------
ma_2 = MassAddition(Input=c_script.Q_s)  # -> Result, PartialResults
ma_3 = MassAddition(Input=hiveiodistrsupsys.PVAreas)  # -> Result, PartialResults
division_2 = Division(A=ma_2.Result, B=ma_3.Result)

# ----
# PV Ertrag (unverschattet)
# Q_s = G * F_F * A_w * g
# [Q_s] = kWh
# [G] = kWh/m^2
# [F_F] = -
# [A_w] = m^2
# [g] = -
simplepanel_2 = SimplePanel(
    Tilt=distrsolar.SolarTechTilt,
    Azimuth=distrsolar.SolarTechAzimuth,
    DHI=epw_reader.DHI,
    DNI=epw_reader.DNI,
    Latitude=epw_reader.Latitude,
    Longitude=epw_reader.Longitude)

# ----
# Energy Hub
python_5 = GhPythonScript(emitters=hiveiodistr.HiveIOEnergySystemsEmitter)  # -> out, monthlyHeatingSupTemp, monthlyCoolingSupTemp, heatingCarrier, monthlyHeatingReturnTemp, yearlyHeatingSupTemp, yearlyHeatingReturnTemp, monthlyCoolingReturnTemp; inputs emitters: list
# ---------- python_5: Python ----------
__author__ = "chwaibel"
__version__ = "2020.08.20"

import rhinoscriptsyntax as rs

for e in emitters:
    if e.IsCooling:
        monthlyCoolingSupTemp = e.InletCarrier.MonthlyTemperature
        monthlyCoolingReturnTemp = e.ReturnCarrier.MonthlyTemperature
    else:
        monthlyHeatingSupTemp = e.InletCarrier.MonthlyTemperature
        heatingCarrier = e
        monthlyHeatingReturnTemp = e.ReturnCarrier.MonthlyTemperature
        yearlyHeatingSupTemp = e.InletCarrier.Temperature
        yearlyHeatingReturnTemp = e.ReturnCarrier.Temperature
# ---------- end python_5 ----------
bool_2 = Boolean(toggle_5)

# ----
# PV / ST
python_6 = GhPythonScript(x=irrmshy_2)  # -> out, a
# ---------- python_6: Python ----------
__author__ = "chwaibel"
__version__ = "2020.08.21"

import rhinoscriptsyntax as rs

a = x.I_hourly
# ---------- end python_6 ----------
hivemergersolartech = MergerSolarTechHive(
    I_hourlyM=python_6.a,
    SolarTech=hiveiodistr.HiveIOEnergySystemSurfaceBasedTech,
    Air=hivedistenvironment.AmbientAirTemp,
    SupplyTemp=python_5.yearlyHeatingSupTemp,
    ReturnTemp=python_5.yearlyHeatingReturnTemp,
    SimpleMode=bool_2,
    I_hourly=simplepanel_2)
python_7 = GhPythonScript(x=hivemergersolartech)  # -> out, a
# ---------- python_7: Python ----------
__author__ = "chwaibel"
__version__ = "2020.08.24"

import rhinoscriptsyntax as rs
a = x.OutputCarriers[0].MonthlyCumulativeEnergy
# ---------- end python_7 ----------
panel_5 = Panel(hivemergersolartech)
ma_4 = MassAddition(Input=python_7.a)  # -> Result, PartialResults
graph_2 = QuickGraph(python_7.a, SortOrder=0)
panel_6 = Panel(ma_4.Result)

# ----
# Heat Exchanger for District Heating
hivemergerhx = MergerHeatExchangerHive(
    DistrictHeating=hivedistenvironment.DistrictHeating,
    HeatDemand=sia380.Q_Heat,
    SuppTemp=python_5.monthlyHeatingSupTemp,
    ReturnTemp=python_5.monthlyHeatingReturnTemp,
    HeatExchanger=nickname.HiveIOEnergySystemsHeatExchanger)
panel_7 = Panel(hivemergerhx)

# ----
# Gas Boiler
hivemergerboiler = MergerGasBoilerHive(
    Gas=hivedistenvironment.NaturalGas,
    HeatDemand=sia380.Q_Heat,
    SuppTemp=python_5.monthlyHeatingSupTemp,
    HiveIOGasBoiler=nickname.HiveIOEnergySystemsBoiler)
panel_8 = Panel(hivemergerboiler)

# ----
# Air Source Heat Pump
hivemergerashp = MergerAirSourceHeatPumpHive(
    Air=hivedistenvironment.AmbientAirTemp,
    Electricity=hivedistenvironment.GridElectricity,
    HeatGenerated=sia380.Q_Heat,
    SuppTemp=python_5.monthlyHeatingSupTemp,
    SimpleMode=bool_2,
    ASHP=nickname.HiveIOEnergySystemAirSourceHeatPump)
panel_9 = Panel(hivemergerashp)

# ----
# CHP
hivemergerchp = MergerCHPHive(
    Gas=hivedistenvironment.NaturalGas,
    EnergyDemand=sia380.Q_Elec,
    IsHeatingDemand=False,
    SuppTemp=python_5.monthlyHeatingSupTemp,
    HiveIOCombinedHeatPower=nickname.HiveIOEnergySystemsCombinedHeatPowert)
panel_10 = Panel(hivemergerchp)

# ----
# Heat Exchanger for District Cooling
hivemergercx = MergerCoolingExchangerHive(
    DistrictCooling=hivedistenvironment.DistrictCooling,
    CoolDemand=abs,
    SuppTemp=python_5.monthlyCoolingSupTemp,
    ReturnTemp=python_5.monthlyCoolingReturnTemp,
    CoolingExchanger=nickname.HiveIOEnergySystemsCoolExchanger)
panel_11 = Panel(hivemergercx)

# ----
# Chiller
hivemergerchiller = MergerChillerHive(
    Air=hivedistenvironment.AmbientAirTemp,
    Electricity=hivedistenvironment.GridElectricity,
    CoolingGenerated=abs,
    CondenserTemp=python_5.monthlyCoolingSupTemp,
    SimpleMode=bool_2,
    Chiller=nickname.HiveIOEnergySystemChiller)
panel_12 = Panel(hivemergerchiller)

python_8 = GhPythonScript(chiller=hivemergerchiller, ashp=hivemergerashp, siaElec=sia380.Q_Elec)  # -> out, additionalElec; inputs siaElec: list
# ---------- python_8: Python ----------
__author__ = "Christoph"
__version__ = "2020.09.13"

import rhinoscriptsyntax as rs
if chiller != None and ashp != None:
    additionalElec = [a+b+c for a,b,c in zip(chiller.InputCarrier.MonthlyCumulativeEnergy, ashp.InputCarrier.MonthlyCumulativeEnergy, siaElec)]
elif ashp != None and chiller is None:
    additionalElec = [a+b for a,b in zip(ashp.InputCarrier.MonthlyCumulativeEnergy, siaElec)]
elif ashp is None and chiller != None:
    additionalElec = [a+b for a,b in zip(chiller.InputCarrier.MonthlyCumulativeEnergy, siaElec)]
else:
    additionalElec = siaElec
# ---------- end python_8 ----------
python_9 = GhPythonScript(pvOrSt=hivemergersolartech, elecDemandIn=python_8.additionalElec, heatDemandIn=sia380.Q_Heat)  # -> out, flatten(elecDemandOut), heatDemandOut; inputs elecDemandIn: list, heatDemandIn: list
# ---------- python_9: Python ----------
__author__ = "Christoph"
__version__ = "2020.09.13"

import rhinoscriptsyntax as rs
import Hive.IO.EnergySystems
if(pvOrSt != None):
    energyRenewable = pvOrSt.OutputCarriers[0].MonthlyCumulativeEnergy

if(type(pvOrSt) == Hive.IO.EnergySystems.Photovoltaic):
    elecDemandOut = [x - y for x, y in zip(elecDemandIn, energyRenewable)]
    heatDemandOut = heatDemandIn
elif(type(pvOrSt) == Hive.IO.EnergySystems.SolarThermal):
    heatDemandOut = [x - y for x, y in zip(heatDemandIn, energyRenewable)] 
    elecDemandOut = elecDemandIn
else:
    heatDemandOut = heatDemandIn
    elecDemandOut = elecDemandIn
# ---------- end python_9 ----------

# ----
# Plug-in any conversion tech
python_10 = GhPythonScript(x=hivemergerchiller)  # -> out, description, outEnergy
# ---------- python_10: Python ----------
__author__ = "chwaibel"
__version__ = "2020.08.18"

import rhinoscriptsyntax as rs

a = ("total investment cost: ", x.SpecificInvestmentCost * x.Capacity)
b = ("capacity: ", x.Capacity)
c = ("cap unit; ", x.CapacityUnit)
d = ("name: ", x.Name)
e = ("opCost CHF/a: ", sum(x.InputCarrier.TotalEnergyCost))
f = ("tot Input Energy kWh/a: ", sum(x.InputCarrier.Energy))
g = ("Tot Output Energy kWh/a: ", sum(x.OutputCarriers[0].MonthlyCumulativeEnergy))
h = ("Inp Car PEF: ", x.InputCarrier.PrimaryEnergyFactor)
description = [a, b, c, d, e, f, g, h]

# print(x.InputCarrier.MonthlyCumulativeEnergy)
#print(x.OutputCarriers[0].Energy)
print(x.InputCarrier.PrimaryEnergyFactor)
print("Input type: ", type(x.InputCarrier))
print("Output type: ", type(x.OutputCarriers[0]))
outEnergy = x.OutputCarriers[0].MonthlyCumulativeEnergy
print(x.IsCooling)
# ---------- end python_10 ----------
panel_13 = Panel(python_10.description)

# ----
# Purchased Grid Electricity for appliances
hivemergersubstation = MergerElectricalSubstationHive(
    GridElectricity=hivedistenvironment.GridElectricity,
    ElecPurchased=python_9.elecDemandOut,
    ElectricalSubstation=nickname.HiveIOEnergySystemElectricalSubstation)
panel_14 = Panel(hivemergersubstation)

# ----
# Results
hiveresults = ResultsHive(
    CoolingMonthly=abs,
    HeatingMonthly=python_9.heatDemandOut,
    ElectricityMonthly=python_9.elecDemandOut,
    HiveBuilding=hiveiodistr.HiveIOBuilding,
    HiveConversionTech=flatten([hivemergerboiler, hivemergerhx, hivemergercx, hivemergersolartech, hivemergersubstation, hivemergerchiller, hivemergerashp]),
    Q_T=sia380.Q_T_opaque,
    Q_V=sia380.Q_T_transparent,
    Q_i=sia380.Q_V,
    Q_s=sia380.Q_i,
    Q_s_2=sia380.Q_s,
    ConsumedElec=python_8.additionalElec,
    ConsumedHeat=sia380.Q_Heat,
    Q_s_per_win=sia380.Q_s_per_windows)
python_11 = GhPythonScript(x=hiveresults)  # -> out, a
# ---------- python_11: Python ----------
__author__ = "chwaibel"
__version__ = "2020.09.23"

import rhinoscriptsyntax as rs
print("IN")
print("SolarGains: ", x.TotalSolarGains)
print("InternalGains: ", x.TotalInternalGains)
print("PrimaryEnergy: ", sum(x.TotalPrimaryEnergyMonthlyNonRenewable))
print("RenewableEnergy: ", sum(x.TotalFinalEnergyMonthlyRenewable))
print("OUT")
print("Electricity: ", sum(x.TotalConsumedElectricityMonthly))
print("VentilationLosses: ", x.TotalVentilationHeatLosses)
print("EnvelopeLosses: ", x.TotalOpaqueTransmissionHeatLosses)
print("WindowLosses: ", x.TotalWindowTransmissionHeatLosses)
print("SystemLosses: ", x.TotalSystemLosses)
print("ActiveCooling: ", sum(x.TotalActiveCoolingMonthly))
print("SurplusElectricity: ", sum(x.TotalFeedInElectricityMonthly))
print("SurplusHeating: ", sum(x.TotalSurplusHeatingMonthly))
print("Technologies")
print(x.ConversionTechnologies)

print(x.Building.Zones[0].HeatingLoadsMonthly)
# ---------- end python_11 ----------

hive_io_visualizer = HiveIOVisualizer(hiveresults)
panel_15 = Panel(python_11.out)
