# Grasshopper definition Hive_Merger_Test.gh (Grasshopper 1.0.7)
# plug-ins: HiveIO, solar-tech, sia380Parameters, solar, heatpumps, sia380, cooling, GHSolar, epw-reader, combustion

rooms_standard = RoomsStandard({"1.1 Wohnen Mehrfamilienhaus": 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, "1.2 Wohnen Einfamilienhaus": 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, "2.1 Hotelzimmer": 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, "2.2 Empfang, Lobby": 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, "3.1 Einzel-, Gruppenbuero": {"description": "3.1 Einzel-, Gruppenbuero", "Raumlufttemperatur Auslegung Heizen (Winter)": 21.0, "Nettogeschossflaeche": 36.0, "Thermische Gebaeudehuellflaeche": 42.0, "U-Wert Fenster": 1.2, "Waermeeintragsleistung Personen (bei 24.0 deg C, bzw. 70 W)": 5.0, "Jaehrliche Vollaststunden der Geraete": 1930.0, "U-Wert opake Bauteile": 0.20000000000000001, "Jaehrliche Vollaststunden der Raumbeleuchtung": 1210.0, "Vollaststunden pro Jahr (Personen)": 1500.0, "Abminderungsfaktor fuer Fensterrahmen": 0.75, "Aussenluft-Volumenstrom durch Infiltration": 0.14999999999999999, "Raumlufttemperatur Auslegung Kuehlung (Sommer)": 26.0, "Glasanteil": 50.0, "Zeitkonstante": 117.0, "Waermeeintragsleistung der Raumbeleuchtung": 15.9, "Waermeeintragsleistung der Geraete": 7.0, "Gesamtenergiedurchlassgrad Verglasung": 0.5, "Temperatur-Aenderungsgrad der Waermerueckgewinnung": 0.69999999999999996, "Aussenluft-Volumenstrom (pro NGF)": 2.6000000000000001}, "3.2 Grossraumbuero": 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, "3.3 Sitzungszimmer": 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, "3.4 Schalterhalle, Empfang": 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, "4.1 Schulzimmer": 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, "4.2 Lehrerzimmer": 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}, selected="3.1 Einzel-, Gruppenbuero")
rooms_existing = RoomsExisting({"1.1 Wohnen Mehrfamilienhaus": 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, "1.2 Wohnen Einfamilienhaus": {"description": "1.2 Wohnen Einfamilienhaus", "Raumlufttemperatur Auslegung Heizen (Winter)": 21.0, "Nettogeschossflaeche": 20.0, "Thermische Gebaeudehuellflaeche": 38.0, "U-Wert Fenster": 1.5, "Waermeeintragsleistung Personen (bei 24.0 deg C, bzw. 70 W)": 1.3999999999999999, "Jaehrliche Vollaststunden der Geraete": 1780.0, "U-Wert opake Bauteile": 0.80000000000000004, "Jaehrliche Vollaststunden der Raumbeleuchtung": 1450.0, "Vollaststunden pro Jahr (Personen)": 4090.0, "Abminderungsfaktor fuer Fensterrahmen": 0.75, "Aussenluft-Volumenstrom durch Infiltration": 0.29999999999999999, "Raumlufttemperatur Auslegung Kuehlung (Sommer)": 26.0, "Glasanteil": 30.0, "Zeitkonstante": 56.0, "Waermeeintragsleistung der Raumbeleuchtung": 2.7000000000000002, "Waermeeintragsleistung der Geraete": 10.0, "Gesamtenergiedurchlassgrad Verglasung": 0.65000000000000002, "Temperatur-Aenderungsgrad der Waermerueckgewinnung": NaN, "Aussenluft-Volumenstrom (pro NGF)": 0.59999999999999998}, "2.1 Hotelzimmer": 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, "2.2 Empfang, Lobby": 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, "3.1 Einzel-, Gruppenbuero": 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, "3.2 Grossraumbuero": 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, "3.3 Sitzungszimmer": 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, "3.4 Schalterhalle, Empfang": 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, "4.1 Schulzimmer": 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, "4.2 Lehrerzimmer": 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}, selected="1.2 Wohnen Einfamilienhaus")
rooms_ideal = RoomsIdeal({"1.1 Wohnen Mehrfamilienhaus": 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, "1.2 Wohnen Einfamilienhaus": {"description": "1.2 Wohnen Einfamilienhaus", "Raumlufttemperatur Auslegung Heizen (Winter)": 21.0, "Nettogeschossflaeche": 20.0, "Thermische Gebaeudehuellflaeche": 38.0, "U-Wert Fenster": 0.90000000000000002, "Waermeeintragsleistung Personen (bei 24.0 deg C, bzw. 70 W)": 1.3999999999999999, "Jaehrliche Vollaststunden der Geraete": 1780.0, "U-Wert opake Bauteile": 0.10000000000000001, "Jaehrliche Vollaststunden der Raumbeleuchtung": 1110.0, "Vollaststunden pro Jahr (Personen)": 4090.0, "Abminderungsfaktor fuer Fensterrahmen": 0.75, "Aussenluft-Volumenstrom durch Infiltration": 0.14999999999999999, "Raumlufttemperatur Auslegung Kuehlung (Sommer)": 26.0, "Glasanteil": 30.0, "Zeitkonstante": 238.0, "Waermeeintragsleistung der Raumbeleuchtung": 1.7, "Waermeeintragsleistung der Geraete": 4.0, "Gesamtenergiedurchlassgrad Verglasung": 0.5, "Temperatur-Aenderungsgrad der Waermerueckgewinnung": 0.80000000000000004, "Aussenluft-Volumenstrom (pro NGF)": 0.59999999999999998}, "2.1 Hotelzimmer": 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, "2.2 Empfang, Lobby": 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, "3.1 Einzel-, Gruppenbuero": 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, "3.2 Grossraumbuero": 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, "3.3 Sitzungszimmer": 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, "3.4 Schalterhalle, Empfang": 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, "4.1 Schulzimmer": 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, "4.2 Lehrerzimmer": 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}, selected="1.2 Wohnen Einfamilienhaus")

# ---- group: Pfad zur Wetterdatei (*.epw)
# EuKS2 - Heizwärmebedarf und PV Ertrag (simuliert)
# Berechnungen zur Abschätzung des Wärmebedarfs.
# Basiert auf der Excel Tabelle "Interaktion Struktur, Klima und Wärmebedarf.xlsx"
# 
# Sonneneinstrahlung simuliert gemäss "Waibel, C., Evins, R., Carmeliet, J. 2017. Efficient time-resolved 3D solar potential modelling. Solar Energy 158 (2017) 960–976."
panel = Panel("C:\EnergyPlusV9-1-0\WeatherData\USA_FL_Tampa.Intl.AP.722110_TMY3.epw")

# ---- group: PV Fläche
srf = Surface(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)

# ---- group: Boden
mesh = Mesh(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)

# ---- group: Gebäudevolumen
brep = Brep(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)

# ----
mesh_uv = MeshSurface(Surface=srf, UCount="6", VCount="6", Overhang=True, Equalize=False)

# ---- group: Umgebungsbebauung
mesh_2 = Mesh([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])

# ---- group: Fensterflächen
srf_2 = Surface([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])

# ----
hiveparainemitter = ParametricInputEmitterHive(Vorlauf="35", Rücklauf="25", Capacity="1000", InvestmentCost="1000", EmbodiedEmissions="1000")
hiveiosolar = HiveIOSolarTech(Mesh=mesh_uv, EmitterJson=hiveparainemitter)  # -> flatten(HiveIOEnergySystemSurfaceSystem)
hive_io_bldg = HiveIOBuilding(ZoneBrepGeometries=brep, WindowsSurfaces=srf_2, SIA2024Room_2=rooms_standard)
hive_io_env = HiveIOEnvironment(EPWPath=panel, ObstaclesGeometry=[mesh, mesh_2])
hiveiodistr = HiveIODistributor(HiveInputObjects=[hive_io_env, hive_io_bldg, hiveiosolar])  # -> HiveIOBuilding, HiveIOEnvironment, HiveIOEnergySystemSurfaceBasedTech, HiveIOEnergySystemConversionTech, HiveIOEnergySystemsEmitter
python = GhPythonScript(investment_cost="1000", embodied_ghg="1000", capacity="1000")  # -> out, ashp, chiller, boiler, chp
# ---------- python: Python ----------
__author__ = "Chris"
__version__ = "2020.08.05"

import rhinoscriptsyntax as rs
import Hive.IO.EnergySystems as hive

ashp = hive.AirSourceHeatPump(investment_cost, embodied_ghg, capacity, 3.5)
chiller = hive.Chiller(investment_cost, embodied_ghg, capacity, 3.5)
boiler = hive.GasBoiler(investment_cost, embodied_ghg, capacity, 0.95)
chp = hive.CombinedHeatPower(investment_cost, embodied_ghg, capacity, 1.5, 0.3)
# ---------- end python ----------
hiveparainensys = ParametricInputEnergySystemsHive(
    ASHPCapacity="1000",
    ASHPCost="1000",
    ASHPEmissions="1000",
    ASHPCOP="3.5",
    NGBoilerCapacity="1000",
    NGBoilerCost="1000",
    NGBoilerEmissions="1000",
    NGBoilerEfficiency="0.95",
    CHPCapacity="1000",
    CHPCost="1000",
    CHPEmissions="1000",
    CHPHTP="1.5",
    CHPEffElec="0.3")
nickname = GhDistributorConversionTech(HiveIOEnergySystemConversionTech=hiveiodistr.HiveIOEnergySystemConversionTech)  # -> HiveIOEnergySystemAirSourceHeatPump, HiveIOEnergySystemChiller
distrsolar = HiveIODistributorSolar(
    HiveIOBuilding=hiveiodistr.HiveIOBuilding,
    HiveIOEnergySystemSurfaceBased=hiveiodistr.HiveIOEnergySystemSurfaceBasedTech,
    HiveIOEnvironment=hiveiodistr.HiveIOEnvironment)  # -> EnvironmentMesh, BuildingCentroid, ExternalSurfaces, WindowGeometries, SolarTechMesh, WindowAzimuth, WindowAreas, SolarTechMesh_2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
hiveiodistrsupsys = HiveIODistributorSupplySystem(HiveIOEnergySystemsSurfaceBased=hiveiodistr.HiveIOEnergySystemSurfaceBasedTech)  # -> EfficiencyPV, PVAreas, EfficiencyST, STAreas, ElectricEfficiencyPVT, ThermalEfficiencyPVT, PVTAreas
distributorsia = DistributorSIA(BuildingObj=hiveiodistr.HiveIOBuilding)  # -> ZoneAreas, WindowsAreas, ExtSrfAreas, SIA2024json
hiveiodistrepw = HiveIODistributorEPW(HiveIOEnvironment=hiveiodistr.HiveIOEnvironment)  # -> Filepath, InputCarriers
epw_reader = EPWReader(Path=hiveiodistrepw.Filepath)  # -> Latitude, Longitude, CityCountry, GHI, DNI, DHI, DryBulb, DewPoint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
sia2024 = SIA2024Rooms(
    Room=distributorsia.SIA2024json,
    Area=distributorsia.ZoneAreas,
    Month=[1, 2, 3, 4, 5, 6, 7, 8, 9, 10, 11, 12],
    Season="winter")  # -> Τ_h, Θ_i_C, T_h, A_op_m2, A_w_m2, U_op_W_m2K, U_w_W_m2K, V_e_m3_h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
adaptcomf = AdaptiveComfort(T_m=epw_reader.DryBulbMonthly)  # -> T_n, T_n80ub, T_n80lb, T_n90ub, T_n90lb

# ----
# PV Ertrag (simuliert)
data = Data([0.8, 0.8, 0.8, 0.8, 0.8, 0.8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])
mesh_3 = Mesh(distrsolar.ExternalSurfaces)
obstobj = ObstacleObject(Mesh=distrsolar.SolarTechMesh, Albedo=data, SpecCoeff=data, ReflType=0, Tolerance=0.01, Name="PV", MT=True)
obstobj_2 = ObstacleObject(Mesh=[distrsolar.EnvironmentMesh, mesh_3], Albedo=data, SpecCoeff=data, ReflType=0, Tolerance=0.01, Name="PV", MT=True)
irrmshy = IrradiationMeshYear(
    AnalysisObjects=obstobj,
    ObstacleObjects=obstobj_2,
    Latitude=epw_reader.Latitude,
    Longitude=epw_reader.Longitude,
    Year=2017,
    DNI=epw_reader.DNI,
    DHI=epw_reader.DHI,
    MainSkyRes=1,
    SpecBounces=0,
    DiffIReflSkyRes=0,
    DiffIReflMode=2,
    MT=True)
readresults = ReadResults(Mesh=distrsolar.SolarTechMesh, I=irrmshy, Value=7)  # -> Results, SP
visumshsol = VisualizeMeshSolar(Mesh=distrsolar.SolarTechMesh, I=irrmshy, Value=0)
python_2 = GhPythonScript(x=simplify(readresults.Results), month=[0, 1, 2, 3, 4, 5, 6, 7, 8, 9, 10, 11])  # -> out, a; inputs x: list, month: Int32
# ---------- python_2: Python ----------
__author__ = "chwaibel"
__version__ = "2020.02.25"

import rhinoscriptsyntax as rs

# 8760 time series
# get monthly average...
# how to know how many days a month? somewhere, I have typical year.
# in some honey-badger script

dayspermonth = [31.0, 28.0, 31.0, 30.0, 31.0, 30.0, 31.0, 31.0, 30.0, 31.0, 30.0, 31.0]

hour_per_day = 24
start_hour = int(hour_per_day * sum(dayspermonth[0:month])) 
end_hour = int(hour_per_day * sum(dayspermonth[0:month+1]))

cumulative_data = sum(x[start_hour:end_hour])

a = cumulative_data / 1000
# ---------- end python_2 ----------
c_script = CSharpScript(G=python_2.a, g=hiveiodistrsupsys.EfficiencyPV)  # -> out, Q_s; inputs G: tree of Double, g: list of Double
# ---------- c_script: C# ----------
    int winCount = G.BranchCount;
    double [] Q_array = new double[12];

    DataTree<double> doubleTree = new DataTree<double>();
    for (int i = 0; i < G.BranchCount; i++)
    {
      for (int j = 0; j < G.Branch(i).Count; ++j) // should be 12, 1 for each month of the year
      {
        GH_Path path = new GH_Path(i, j);
        double irrad = G.Branch(i)[j]  * g[i];
        doubleTree.Add(irrad, path);

        Q_array[j] += irrad;
      }
    }

    Q_s = Q_array;
# ---------- end c_script ----------
ma = MassAddition(Input=c_script.Q_s)  # -> Result, PartialResults
ma_2 = MassAddition(Input=hiveiodistrsupsys.PVAreas)  # -> Result, PartialResults
division = Division(A=ma.Result, B=ma_2.Result)

# ----
# Solare Wärmeeinträge
mesh_4 = MeshBrep(
    Brep=distrsolar.WindowGeometries,
    Settings={GridMaxCount=0, GridMinCount=16, JaggedSeams=False, MaxEdgeLength=0, MinEdgeLength=0.0001, MinTolerance=0, Refine=True, RefineAngle=0, RelativeTolerance=0.65, SimplePlanes=True, Tolerance=0})
obstobj_3 = ObstacleObject(Mesh=mesh_4, Albedo=data, SpecCoeff=data, ReflType=0, Tolerance=0.01, Name="PV", MT=True)
irrmshy_2 = IrradiationMeshYear(
    AnalysisObjects=obstobj_3,
    ObstacleObjects=obstobj_2,
    Latitude=epw_reader.Latitude,
    Longitude=epw_reader.Longitude,
    Year=2017,
    DNI=epw_reader.DNI,
    DHI=epw_reader.DHI,
    MainSkyRes=1,
    SpecBounces=0,
    DiffIReflSkyRes=0,
    DiffIReflMode=2,
    MT=True)
item = ListItem(List=sia2024.G_, Index=0, Wrap=True)
readresults_2 = ReadResults(Mesh=mesh_4, I=irrmshy_2, Value=7)  # -> simplify(Results), SP
python_3 = GhPythonScript(x=simplify(readresults_2.Results), month=[0, 1, 2, 3, 4, 5, 6, 7, 8, 9, 10, 11])  # -> out, a; inputs x: list, month: Int32; same code as python_2
c_script_2 = CSharpScript(G=python_3.a, g=item)  # -> out, Q_s; inputs G: tree of Double, g: Double
# ---------- c_script_2: C# ----------
    int winCount = G.BranchCount;
    double [] Q_array = new double[12];

    DataTree<double> doubleTree = new DataTree<double>();
    for (int i = 0; i < G.BranchCount; i++)
    {
      for (int j = 0; j < G.Branch(i).Count; ++j) // should be 12, 1 for each month of the year
      {
        GH_Path path = new GH_Path(i, j);
        double irrad = G.Branch(i)[j] *  g;
        doubleTree.Add(irrad, path);

        Q_array[j] += irrad;
      }
    }

    Q_s = Q_array;
# ---------- end c_script_2 ----------
panel_2 = Panel(c_script_2.Q_s)

# ----
# SOLAR SIMULATION
# Solare Wärmeeinträge
# Q_s = G * F_F * A_w * g
# [Q_s] = kWh
# [G] = kWh/m^2
# [F_F] = -
# [A_w] = m^2
# [g] = -
c_script_3 = CSharpScript(x=distrsolar.WindowGeometries)  # -> out, tilt, azimuth, area; inputs x: Brep
# ---------- c_script_3: C# ----------
    Surface srf = x.Surfaces[0];

    AreaMassProperties massProp = AreaMassProperties.Compute(srf);
    Point3d cen = massProp.Centroid;
    double u,v;
    srf.ClosestPoint(cen, out u, out v);
    Vector3d normal = srf.NormalAt(u, v);

    if(x.Faces[0].OrientationIsReversed)
      normal.Reverse();

    Vector3d vnormal = new Vector3d(0, 0, 1);
    Vector3d tiltZ0 = new Vector3d(0, 0, 1);

    double tiltValue = Vector3d.VectorAngle(normal, tiltZ0, vnormal);
    tilt = tiltValue * (180.0 / Math.PI);

    double azimuthValue = Vector3d.VectorAngle(new Vector3d(normal.X, normal.Y, 0), new Vector3d(0, 1, 0), vnormal);
    azimuth = azimuthValue * (180 / Math.PI);

//    Line normalLine = new Line(cen, cen + normal);
//    Line azimuthLine = new Line(cen, cen + new Vector3d(0, 1, 0));
//    Line tiltLine = new Line(cen, cen + tiltZ0);
//    A = normalLine;
//    B = azimuthLine;
//    C = tiltLine;


    area = AreaMassProperties.Compute(x.Faces[0]).Area;
# ---------- end c_script_3 ----------
simplepanel = SimplePanel(
    Tilt=c_script_3.tilt,
    Azimuth=c_script_3.azimuth,
    DHI=epw_reader.DHI,
    DNI=epw_reader.DNI,
    Latitude=epw_reader.Latitude,
    Longitude=epw_reader.Longitude)
python_4 = GhPythonScript(x=simplify(simplepanel), month=[0, 1, 2, 3, 4, 5, 6, 7, 8, 9, 10, 11])  # -> out, a; inputs x: list, month: Int32; same code as python_2
c_script_4 = CSharpScript(G=python_4.a, A_w=c_script_3.area, g=item)  # -> out, Q_s; inputs G: tree of Double, A_w: list of Double, g: Double
# ---------- c_script_4: C# ----------
    int winCount = G.BranchCount;
    double [] Q_array = new double[12];

    DataTree<double> doubleTree = new DataTree<double>();
    for (int i = 0; i < G.BranchCount; i++)
    {
      for (int j = 0; j < G.Branch(i).Count; ++j) // should be 12, 1 for each month of the year
      {
        GH_Path path = new GH_Path(i, j);
        double irrad = G.Branch(i)[j] * A_w[i] * g;
        doubleTree.Add(irrad, path);

        Q_array[j] += irrad;
      }
    }

    Q_s = Q_array;
# ---------- end c_script_4 ----------
panel_3 = Panel(c_script_4.Q_s)

# ---- group: NEW SIA 380 COMPONENT / unobstructed
c_script_5 = CSharpScript(G=python_4.a, A_w=c_script_3.area, g=item)  # -> out, Q_s; inputs G: tree of Double, A_w: list of Double, g: Double
# ---------- c_script_5: C# ----------
    int winCount = G.BranchCount;
    double [][] Q_array = new double[12][];
    for(int j = 0; j < G.Branch(0).Count; j++)
      Q_array[j] = new double[G.BranchCount];

    DataTree<double> doubleTree = new DataTree<double>();
    for (int i = 0; i < G.BranchCount; i++)
    {
      for (int j = 0; j < G.Branch(i).Count; ++j) // should be 12, 1 for each month of the year
      {
        GH_Path path = new GH_Path(i, j);
        double irrad = G.Branch(i)[j] * A_w[i] * g;
        doubleTree.Add(irrad, path);

        Q_array[j][i] = irrad*1000;
      }
    }

    jagged output = new jagged();
    output.data = Q_array;
    Q_s = output;
# ---------- c_script_5: C# additional code ----------
  public struct jagged
  {
    public double [][] data;
  }
# ---------- end c_script_5 ----------

# ---- group: NEW SIA 380 COMPONENT / obstructed
c_script_6 = CSharpScript(G=python_3.a, g=item)  # -> out, Q_s; inputs G: tree of Double, g: Double
# ---------- c_script_6: C# ----------
    int winCount = G.BranchCount;
    double [][] Q_array = new double[12][];
    for(int j = 0; j < G.Branch(0).Count; j++)
      Q_array[j] = new double[G.BranchCount];

    DataTree<double> doubleTree = new DataTree<double>();
    for (int i = 0; i < G.BranchCount; i++)
    {
      for (int j = 0; j < G.Branch(i).Count; ++j) // should be 12, 1 for each month of the year
      {
        GH_Path path = new GH_Path(i, j);
        double irrad = G.Branch(i)[j] * g;
        doubleTree.Add(irrad, path);

        Q_array[j][i] = irrad*1000;
      }
    }
    jagged jag = new jagged();
    jag.data = Q_array;

    Q_s = jag;
# ---------- c_script_6: C# additional code ----------
  public struct jagged
  {
    public double [][] data;
  }
# ---------- end c_script_6 ----------

# ---- group: NEW SIA 380 COMPONENT
# DEMAND MODELING
panel_4 = Panel("""transp
transp
transp
transp
transp
opaque""")
subtraction = Subtraction(A=distributorsia.ExtSrfAreas, B=distributorsia.WindowsAreas)
merge = Merge(Data1=c_script_3.area, Data2=subtraction)  # -> flatten(Result)
sia380 = SIA380(
    Room_properties=distributorsia.SIA2024json,
    Floor_area=distributorsia.ZoneAreas,
    T_e=epw_reader.DryBulbMonthly,
    Setpoints_ub=adaptcomf.T_n90ub,
    Setpoints_lb=adaptcomf.T_n90lb,
    Surface_areas=merge,
    Surface_type=panel_4,
    Q_s_per_surface=c_script_6.Q_s)  # -> Q_Heat, Q_Cool, Q_Elec, Q_T, Q_V, Q_i, Q_s
ma_3 = MassAddition(Input=sia380.Q_Heat)  # -> Result, PartialResults
division_2 = Division(A=ma_3.Result, B=distributorsia.ZoneAreas)

# ----
# EHub Parameters
python_5 = GhPythonScript()  # -> out, supplyTemperature, monthlySupTemp
# ---------- python_5: Python ----------
__author__ = "Chris"
__version__ = "2020.08.05"

import rhinoscriptsyntax as rs
import Hive.IO.EnergySystems as hive

sup_temp = emitter.ReturnCarrier.SupplyTemperature

supplyTemperature = sup_temp

monthlySupTemp = emitter.ReturnCarrier.MonthlySupplyTemperature;
# ---------- end python_5 ----------
gas_price_chf_kwh = Panel("0.209")
emission_factor_electricity_kgco2_kwh = Panel("0.209")
emission_factor_natural_gas_kgco2_kwh = Panel("0.27")
cost_electricity_chf_kwh = Panel("0.27")
horizon = Panel("12")

# ----
# Chiller
python_6 = GhPythonScript(emissionFactor=emission_factor_electricity_kgco2_kwh)  # -> out, emissionTimeseries
# ---------- python_6: Python ----------
__author__ = "chwaibel"
__version__ = "2020.08.12"

import rhinoscriptsyntax as rs

horizon = 12

emissionTimeseries = [emissionFactor] * horizon
# ---------- end python_6 ----------
python_7 = GhPythonScript(elecPrice=cost_electricity_chf_kwh)  # -> out, elecTimeseries
# ---------- python_7: Python ----------
__author__ = "chwaibel"
__version__ = "2020.08.12"

import rhinoscriptsyntax as rs

horizon = 12

elecTimeseries = [elecPrice] * horizon
# ---------- end python_7 ----------
python_8 = GhPythonScript(airCarrier=epw_reader.AmbientTemperatureCarrier)  # -> out, airTemperature
# ---------- python_8: Python ----------
__author__ = "chwaibel"
__version__ = "2020.08.12"

import rhinoscriptsyntax as rs

airTemperature = airCarrier.AvailableEnergy
# ---------- end python_8 ----------
abs = Absolute(Value=sia380.Q_Cool)
chiller_tr = ChillerTr(
    Cooling_loads=abs,
    Elec_cost=python_7.elecTimeseries,
    Elec_emissions=python_6.emissionTimeseries,
    Temperature=python_8.airTemperature)  # -> Elec, Cost, Carbon, COP
python_9 = GhPythonScript(electricityConsumed=chiller_tr.Elec, EF=emission_factor_electricity_kgco2_kwh, price=cost_electricity_chf_kwh)  # -> out, ElectricityCarrier, ghg, cost; inputs electricityConsumed: list
# ---------- python_9: Python ----------
__author__ = "Christoph"
__version__ = "2020.08.06"
from System import Array
import rhinoscriptsyntax as rs
import Hive.IO.EnergySystems as hive

energyCost = [i * price for i in electricityConsumed]
ghgEmissions = [i * EF for i in electricityConsumed]

ElectricityCarrier = hive.Electricity(electricityConsumed.Count, Array[float](electricityConsumed), Array[float](energyCost), Array[float](ghgEmissions))
ghg = ghgEmissions
cost = energyCost
# ---------- end python_9 ----------
hivemergerchiller = MergerChillerHive(
    Air=epw_reader.AmbientTemperatureCarrier,
    Electricity=python_9.ElectricityCarrier,
    Horizon=horizon,
    CoolingGenerated=abs,
    Cost=python_9.cost,
    Ghg=python_9.ghg,
    SuppTemp=python_5.monthlySupTemp,
    Chiller=python.chiller)
panel_5 = Panel(hivemergerchiller)

# ----
# Air Source Heat Pump
cop_ashp = Panel("3.5")
simple_hp = SimpleHp(Q_th=sia380.Q_Heat, COP=cop_ashp)
ma_4 = MassAddition(Input=simple_hp)  # -> Result, PartialResults
python_10 = GhPythonScript(electricityConsumed=simple_hp, EF=emission_factor_electricity_kgco2_kwh, price=cost_electricity_chf_kwh)  # -> out, ElectricityCarrier, ghg, cost; inputs electricityConsumed: list; same code as python_9
division_3 = Division(A=ma_4.Result, B=distributorsia.ZoneAreas)
nickname_2 = GhMergerHeatPump(
    Air=epw_reader.AmbientTemperatureCarrier,
    Electricity=python_10.ElectricityCarrier,
    Horizon=horizon,
    HeatGenerated=sia380.Q_Heat,
    Cost=python_10.cost,
    Ghg=python_10.ghg,
    SuppTemp=python_5.monthlySupTemp,
    ASHP=python.ashp)
panel_6 = Panel(nickname_2)

# ----
# PV / ST
panel_7 = Panel("hourly")
solartechsetoutputs = SolarTechSetOutputs(
    GHSolar_CResults=irrmshy,
    Hive_SurfaceBased=hiveiodistr.HiveIOEnergySystemSurfaceBasedTech,
    Amb_T_carrier=epw_reader.AmbientTemperatureCarrier,
    TimeResolution=panel_7)
python_11 = GhPythonScript(solarTech=solartechsetoutputs)  # -> out, pvHourly, pvMonthly, solarPot, inletWater, ambientAir, panelArea
# ---------- python_11: Python ----------
__author__ = "Christoph"
__version__ = "2020.07.06"

import rhinoscriptsyntax as rs

import Hive.IO.EnergySystems as ensys

pvHourly = solarTech.OutputCarriers[0].AvailableEnergy

pvMonthly = solarTech.OutputCarriers[0].MonthlyCumulativeEnergy

solarPot = solarTech.InputCarrier.AvailableEnergy
if isinstance(solarTech, ensys.SolarThermal):
    inletWater = solarTech.InletWater.SupplyTemperature
ambientAir = solarTech.AmbientAir.AvailableEnergy
panelArea = solarTech.SurfaceArea
# ---------- end python_11 ----------
panel_8 = Panel(solartechsetoutputs)
panel_9 = Panel(python_11.pvMonthly)
graph = QuickGraph(panel_9, SortOrder=0)

# ----
# CHP
panel_10 = Panel("0.3")
chp = Chp(
    Loads=sia380.Q_Heat,
    Eta=panel_10,
    Htp="1.5",
    Fuelcost=gas_price_chf_kwh,
    Fuelemissions=emission_factor_natural_gas_kgco2_kwh)  # -> Gas_consumed, Total_cost, Total_emissions, Heating_gen, Elec_gen
python_12 = GhPythonScript(gasConsumed=chp.Gas_consumed, EF=emission_factor_natural_gas_kgco2_kwh, price=gas_price_chf_kwh)  # -> out, GasCarrier, ghg, cost; inputs gasConsumed: list
# ---------- python_12: Python ----------
__author__ = "Christoph"
__version__ = "2020.08.06"
from System import Array
import rhinoscriptsyntax as rs
import Hive.IO.EnergySystems as hive

energyCost = [i * price for i in gasConsumed]
ghgEmissions = [i * EF for i in gasConsumed]

GasCarrier = hive.Gas(gasConsumed.Count, Array[float](gasConsumed), Array[float](energyCost), Array[float](ghgEmissions))
ghg = ghgEmissions
cost = energyCost
# ---------- end python_12 ----------
hivemergerchp = MergerCHPHive(
    Gas=python_12.GasCarrier,
    Horizon=horizon,
    HeatGenerated=chp.Heating_gen,
    ElecGenerated=chp.Elec_gen,
    Cost=python_12.cost,
    Ghg=python_12.ghg,
    SuppTemp=python_5.monthlySupTemp,
    HiveIOCombinedHeatPower=python.chp)

# ----
# Gas Boiler
boiler_efficiency = Panel("0.95")
boiler = Boiler(
    Heating_loads=sia380.Q_Heat,
    Carrier_cost=gas_price_chf_kwh,
    Carrier_emissions=emission_factor_natural_gas_kgco2_kwh,
    Efficiency=boiler_efficiency)  # -> Gas_consumed, Cost, Carbon
python_13 = GhPythonScript(gasConsumed=boiler.Gas_consumed, EF=emission_factor_natural_gas_kgco2_kwh, price=gas_price_chf_kwh)  # -> out, GasCarrier, ghg, cost; inputs gasConsumed: list; same code as python_12
hivemergerboiler = MergerGasBoilerHive(
    Gas=python_13.GasCarrier,
    Horizon=horizon,
    HeatGenerated=sia380.Q_Heat,
    Cost=python_13.cost,
    Ghg=python_13.ghg,
    SuppTemp=python_5.monthlySupTemp,
    HiveIOGasBoiler=python.boiler)
panel_11 = Panel(hivemergerboiler)

# ----
# Energy Hub
python_14 = GhPythonScript(x=hivemergerchp)  # -> out, description
# ---------- python_14: Python ----------
__author__ = "chwaibel"
__version__ = "2020.08.18"

import rhinoscriptsyntax as rs

a = ("total investment cost: ", x.SpecificInvestmentCost * x.Capacity)
b = ("capacity: ", x.Capacity)
c = ("cap unit; ", x.CapacityUnit)
d = ("name: ", x.Name)

description = [a, b, c, d]
# ---------- end python_14 ----------
panel_12 = Panel(python_14.description)

data_2 = Data([ma_3.Result, ma_4.Result, ma.Result, division_2, division_3, division])

# ----
# Results
hiveresults = ResultsHive(
    CoolingMonthly=sia380.Q_Cool,
    HeatingMonthly=sia380.Q_Heat,
    ElectricityMonthly=sia380.Q_Elec,
    HiveBuilding=hiveiodistr.HiveIOBuilding)
hive_io_visualizer = HiveIOVisualizer(hiveresults)

# ---- group: Heizwärmebedarf, Strombedarf Wärmepumpe und Stromertrag PV
# Jahresheizwärmebedarf in kWh
# Jahresstrombedarf Wärmepumpe in kWh
# Jahresstromertrag PV in kWh
# Jahresheizwärmebedarf in kWh/m^2
# Jahresstrombedarf Wärmepumpe in kWh/m^2
# Jahresstromertrag PV in kWh/m^2 PV
panel_13 = Panel(data_2)
