# Grasshopper definition Hive_Parametric_Inputs.gh (Grasshopper 1.0.7)
# plug-ins: HiveIO, Hive.Core.sia380Parameters

# ----
# Building
list = ValueList({"1.2 Wohnen Einfamilienhaus"}, selected="1.2 Wohnen Einfamilienhaus")
number_slider = Slider(0.25, range=0..1)
rooms_existing = RoomsExisting({"1.1 Wohnen Mehrfamilienhaus": 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, "1.2 Wohnen Einfamilienhaus": {"description": "1.2 Wohnen Einfamilienhaus", "Raumlufttemperatur Auslegung Heizen (Winter)": 21.0, "Nettogeschossflaeche": 20.0, "Thermische Gebaeudehuellflaeche": 38.0, "U-Wert Fenster": 1.5, "Waermeeintragsleistung Personen (bei 24.0 deg C, bzw. 70 W)": 1.3999999999999999, "Jaehrliche Vollaststunden der Geraete": 1780.0, "U-Wert opake Bauteile": 0.80000000000000004, "Jaehrliche Vollaststunden der Raumbeleuchtung": 1450.0, "Vollaststunden pro Jahr (Personen)": 4090.0, "Abminderungsfaktor fuer Fensterrahmen": 0.75, "Aussenluft-Volumenstrom durch Infiltration": 0.29999999999999999, "Raumlufttemperatur Auslegung Kuehlung (Sommer)": 26.0, "Glasanteil": 30.0, "Zeitkonstante": 56.0, "Waermeeintragsleistung der Raumbeleuchtung": 2.7000000000000002, "Waermeeintragsleistung der Geraete": 10.0, "Gesamtenergiedurchlassgrad Verglasung": 0.65000000000000002, "Temperatur-Aenderungsgrad der Waermerueckgewinnung": NaN, "Aussenluft-Volumenstrom (pro NGF)": 0.59999999999999998}, "2.1 Hotelzimmer": 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, "2.2 Empfang, Lobby": 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, "3.1 Einzel-, Gruppenbuero": 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, "3.2 Grossraumbuero": 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, "3.3 Sitzungszimmer": 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, "3.4 Schalterhalle, Empfang": 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, "4.1 Schulzimmer": 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, "4.2 Lehrerzimmer": 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}, selected="1.2 Wohnen Einfamilienhaus")
srf = Surface([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])
brep = Brep(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)
hiveparainroom = ParametricInputSIARoomHive(
    Description=list,
    RoomConstant=Slider(50, range=50..300),
    CoolingSetpoint=Slider(16, range=16..30),
    HeatingSetpoint=Slider(16, range=16..30),
    FloorArea=number_slider,
    EnvelopeArea=number_slider,
    GlazingRatio=number_slider,
    UValueOpaque=number_slider,
    UValueTransparent=number_slider,
    GValue=number_slider,
    GValueTotal=number_slider,
    ShadingSetpoint=number_slider,
    WindowFrameReduction=number_slider,
    AirChangeRate=number_slider,
    Infiltration=number_slider,
    HeatRecovery=number_slider,
    OccupantLoads=number_slider,
    LightingLoads=number_slider,
    EquipmentLoads=number_slider,
    OccupantYearlyHours=number_slider,
    LightingYearlyHours=number_slider,
    EquipmentYearlyHours=number_slider,
    OpaqueCost=number_slider,
    TransparentCost=number_slider,
    OpaqueEmissions=number_slider,
    TransparentEmissions=number_slider)
panel = Panel(hiveparainroom)
python = GhPythonScript(x=<missing>)  # -> out, a
# ---------- python: Python ----------
__author__ = "Christoph"
__version__ = "2020.11.10"

import rhinoscriptsyntax as rs

r = x.SIA2024
print("UValueOpaque: ", r.UValueOpaque)
print("AirChangeRate: ", r.AirChangeRate)
# ---------- end python ----------
panel_2 = Panel(python.out)

# ----
# Environment
panel_3 = Panel("UCT-Mix")
python_2 = GhPythonScript()  # -> out, a
# ---------- python_2: Python ----------
__author__ = "chwaibel"
__version__ = "2020.08.19"

import rhinoscriptsyntax as rs

a = [0.1] * 8760
# ---------- end python_2 ----------
panel_4 = Panel("C:\Users\chwaibel\Documents\GitHub\hive\GrasshopperExamples\LectureExercises\HIVE_Zurich.epw")
hiveparainpotentials = ParametricInputEnergyPotantialsHive(
    NaturalGasName="gazprom",
    NaturalGasPrice=python_2.a,
    NaturalGasEmissions=python_2.a,
    NaturalGasAvailability=python_2.a,
    BioGasName="Altstetten-Biogas",
    BioGasPrice=python_2.a,
    BioGasEmissions=python_2.a,
    BioGasAvailability=python_2.a,
    WoodPelletsName="ZuriWald",
    WoodPelletsPrice=python_2.a,
    WoodPelletsEmissions=python_2.a,
    WoodPelletsAvailability=python_2.a,
    DistrictHeatingName="Schwamendingen",
    DistrictHeatingPrice=python_2.a,
    DistrictHeatingEmissions=python_2.a,
    DistrictHeatingAvailability=python_2.a,
    DistrictHeatingSupplyTemp=python_2.a,
    DistrictCoolingName="Zurilake",
    DistrictCoolingPrice=python_2.a,
    DistrictCoolingEmissions=python_2.a,
    DistrictCoolingAvailability=python_2.a,
    DistrictCoolingSupplyTemp=python_2.a,
    GridElectricityName=panel_3,
    GridElectricityPrice=python_2.a,
    GridElectricityEmissions=python_2.a,
    GridElectricityAvailability=python_2.a)
panel_5 = Panel(hiveparainpotentials)
hiveinputenvironment = InputEnvironmentHive(EPWPath=panel_4, Potentials=hiveparainpotentials)

# ---- group: this solar tech needs to be defined in the Form!
mesh = Mesh(graft(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))

# ----
hive_io_building = HiveIOBuilding()

# ----
# EnergySystems
number_slider_2 = Slider(23.178, range=0..100)
number_slider_3 = Slider(0.25, range=0..100)
number_slider_4 = Slider(0.25, range=0..100)
number_slider_5 = Slider(0, range=0..100)
number_slider_6 = Slider(22.871, range=0..100)
number_slider_7 = Slider(0.25, range=0..100)
mesh_2 = Mesh(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)
mesh_3 = Mesh(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)
nickname = GhParametricInputEnergySystems(
    ASHPCapacity=number_slider_7,
    ASHPCost=number_slider_7,
    ASHPEmissions=number_slider_7,
    ASHPCOP=number_slider_7,
    NGBoilerCapacity=number_slider_5,
    NGBoilerCost=number_slider_5,
    NGBoilerEmissions=number_slider_5,
    NGBoilerEfficiency=number_slider_5,
    CHPCapacity=number_slider_6,
    CHPCost=number_slider_6,
    CHPEmissions=number_slider_6,
    CHPHTP=number_slider_6,
    CHPEffElec=number_slider_6,
    ChillerCapacity=number_slider_2,
    ChillerCost=number_slider_2,
    ChillerEmissions=number_slider_2,
    ChillerCOP=number_slider_2,
    HeatExchangerCapacity=number_slider_4,
    HeatExchangerCost=number_slider_4,
    HeatExchangerEmissions=number_slider_4,
    HeatExchangerLosses=number_slider_4,
    CoolExchangerCapacity=number_slider_3,
    CoolExchangerCost=number_slider_3,
    CoolExchangerEmissions=number_slider_3,
    CoolExchangerLosses=number_slider_3)
emitterinputs = HiveIOEnergySystemsEmitter(
    Vorlauf="65",
    Rücklauf="55",
    Capacity="1.0",
    InvestmentCost="200",
    EmbodiedEmissions="50",
    Name="Heater",
    AirEmitter=False,
    Cooling=False)
emitterinputs_2 = HiveIOEnergySystemsEmitter(
    Vorlauf="20",
    Rücklauf="25",
    Capacity="1.0",
    InvestmentCost="200",
    EmbodiedEmissions="50",
    Name="Cooler",
    AirEmitter="true",
    Cooling="true")
hiveparainsolartech = ParametricInputSolarTechHive(
    Mesh=mesh_3,
    Type="PV",
    Technology="A/S wow tech",
    EfficiencyElectric="0.3",
    EfficiencyThermal="0.0",
    InvestmentCost="3000",
    EmbodiedEmissions="200")
panel_6 = Panel(hiveparainsolartech)
panel_7 = Panel(emitterinputs)
panel_8 = Panel(mesh)
panel_9 = Panel(emitterinputs_2)
panel_10 = Panel(nickname)

hiveparainsolartech_2 = ParametricInputSolarTechHive(
    Mesh=mesh_2,
    Type="ST",
    Technology="NanoBorgTech",
    EfficiencyElectric="0.0",
    EfficiencyThermal="0.2",
    InvestmentCost="2500",
    EmbodiedEmissions="150")

panel_11 = Panel(hiveparainsolartech_2)
hiveinputenergysystems = InputEnergySystemsHive(
    SolarTechProperties=[mesh, hiveparainsolartech_2, hiveparainsolartech],
    conversions="""{
  "$type": "Hive.IO.Forms.ConversionTechPropertiesViewModel[], Hive.IO",
  "$values": []
}""",
    emitters="""{
  "$type": "Hive.IO.Forms.EmitterPropertiesViewModel[], Hive.IO",
  "$values": []
}""",
    meshConnections="""{
  "$type": "System.Collections.Generic.Dictionary`2[[System.Int32, mscorlib],[System.Int32, mscorlib]], mscorlib"
}""",
    meshes="""{
  "$type": "Hive.IO.Forms.SurfaceViewModel[], Hive.IO",
  "$values": [
    {
      "$type": "Hive.IO.Forms.SurfaceViewModel, Hive.IO",
      "Name": "srf0",
      "Area": 23.465697270459675
    }
  ]
}""")
panel_12 = Panel(hiveinputenergysystems)
python_3 = GhPythonScript(x=hiveinputenergysystems)  # -> out, a; inputs x: list
# ---------- python_3: Python ----------
__author__ = "chwaibel"
__version__ = "2020.08.11"

import rhinoscriptsyntax as rs

for tech in x:
    print(type(tech))
    print("Name: ", tech.Name)
    print("Capacity: ", tech.Capacity)
    print("CapacityUnit: ", tech.CapacityUnit)
# ---------- end python_3 ----------
python_4 = GhPythonScript(x=hiveinputenergysystems)  # -> out, a
# ---------- python_4: Python ----------
__author__ = "chwaibel"
__version__ = "2020.08.11"

import rhinoscriptsyntax as rs

a= x.SpecificInvestmentCost
# ---------- end python_4 ----------
panel_13 = Panel(python_4.a)

python_5 = GhPythonScript(tech=hiveinputenergysystems)  # -> out, a
# ---------- python_5: Python ----------
__author__ = "chwaibel"
__version__ = "2020.08.11"

import rhinoscriptsyntax as rs
import Hive.IO.EnergySystems as hive

print(type(tech))
print("Name: ", tech.Name)
print("Capacity: ", tech.Capacity)
print("CapacityUnit: ", tech.CapacityUnit)
if type(tech)==hive.Photovoltaic:
    print("Efficiency: ", tech.RefEfficiencyElectric)
    print("area: ", tech.SurfaceArea)
if type(tech) == hive.SolarThermal:
    print("Efficiency: ", tech.RefEfficiencyHeating)
if type(tech) == hive.GasBoiler:
    print("Efficiency: ", tech.Efficiency)

print("spec cost: ", tech.SpecificInvestmentCost)
print("tot COst: ", tech.SpecificInvestmentCost * tech.Capacity)
# ---------- end python_5 ----------

panel_14 = Panel(python_5.out)
