# Grasshopper definition EaCS3_E02_Hive_SolarUnobstructed.gh (Grasshopper 1.0.7)
# plug-ins: solar, GHSolar, epw-reader

# ---- group: surface orientation
number_slider = Slider(0, range=0..90)
number_slider_2 = Slider(129.177, range=0..360)

# ---- group: Path to weather file (.epw)
panel = Panel("C:\EnergyPlusV9-3-0\WeatherData\USA_CA_San.Francisco.Intl.AP.724940_TMY3.epw")

# ----
# Sunpath and surface insolation
epw_reader = EPWReader(Path=panel)  # -> Latitude, Longitude, CityCountry, GHI, DNI, DHI, DryBulb, DewPoint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
simplepanel = SimplePanel(
    Tilt=number_slider,
    Azimuth=number_slider_2,
    DHI=epw_reader.DHI,
    DNI=epw_reader.DNI,
    Latitude=epw_reader.Latitude,
    Longitude=epw_reader.Longitude,
    Timezone=epw_reader.Timezone)
skydome = GHSkydome(
    RecursionLevel=0,
    SolarVec=False,
    HOY=0,
    Location=[epw_reader.Longitude, epw_reader.Latitude],
    DNI=epw_reader.DNI,
    DHI=epw_reader.DHI,
    Size=Slider(5.774, range=0..10),
    Sp=Point(0, 0, 0),
    Timezone=epw_reader.Timezone)  # -> Mesh, Vectors, Sunpaths, SunGeo
panel_2 = Panel(simplepanel)
crv = Curve(skydome.Sunpaths)
graph = QuickGraph(simplepanel, SortOrder=0)

# ----
# Ladybug Sunpath
ladybug = Ladybug_Ladybug()  # -> Vviiiiiiiiiizzz; disabled; plug-in component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
importepw = Ladybug_ImportEpw(epwFile=panel)  # -> readMe, latitude, location, dryBulbTemperature, dewPointTemperature, relativeHumidity, windSpeed, windDirection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; disabled; plug-in component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
number_slider_3 = Slider(0.05, range=0..1)  # disabled
panel_3 = Panel("24")  # disabled
panel_4 = Panel("1")  # disabled
panel_5 = Panel("12")  # disabled
panel_6 = Panel("365")  # disabled
analysisperiod = Ladybug_AnalysisPeriod(fromMonth=panel_4, fromDay=panel_4, fromHour=panel_4, toMonth=panel_5, toDay=panel_6, toHour=panel_3)  # -> readMe, analysisPeriod; disabled; plug-in component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
sunpath = Ladybug_SunPath(
    location=importepw.location,
    hour=12,
    day=21,
    month=12,
    timeStep=1,
    analysisPeriod=analysisperiod.analysisPeriod,
    sunPathScale=number_slider_3,
    sunScale=number_slider_3,
    dailyOrAnnualSunPath=True)  # -> readMe, sunVectors, sunAltitudes, sunAzimuths, port, sunSpheresMesh, sunPathCrvs, compassCrvs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; disabled; plug-in component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
swatch = ColourSwatch(SwatchColor=RGB(0, 0, 0))  # disabled
preview = CustomPreview(Geometry=[sunpath.sunPathCrvs, sunpath.compassCrvs], Shader=swatch)  # disabled
