# Grasshopper definition Hive_Demand_Hourly.gh (Grasshopper 1.0.7)
# plug-ins: HiveIO, Hive.Core.solar, Hive.Core.sia380, GHSolar, Hive.Core.epw_reader

# ---- group: Path to weather file (.epw)
panel = Panel("C:\Users\Christoph\Documents\GitHub\hive\GrasshopperExamples\LectureExercises\HIVE_Zurich.epw")

# ---- group: refine windows discretisation
panel_2 = Panel("4")
panel_3 = Panel("10")

# ---- group: PV Fläche
srf = Surface(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)

# ---- group: static shading
mesh = Mesh(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)

# ---- group: Ground
mesh_2 = Mesh(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)

# ---- group: Context (City, obstacles, etc.)
mesh_3 = Mesh([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])

# ---- group: Windows
srf_2 = Surface([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])

# ---- group: Building volume
brep = Brep(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)

# ----
mesh_uv = MeshSurface(Surface=srf, UCount="6", VCount="6", Overhang=True, Equalize=False)

# ---- group: Hive model description
hiveinputenergysystems = InputEnergySystemsHive(
    MeshSolarTechnologyProperties=mesh_uv,
    conversions="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",
    emitters="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",
    meshConnections="""{
  "$type": "System.Collections.Generic.Dictionary`2[[System.Int32, mscorlib],[System.Int32, mscorlib]], mscorlib"
}""",
    meshes="""{
  "$type": "Hive.IO.Forms.SurfaceViewModel[], Hive.IO",
  "$values": [
    {
      "$type": "Hive.IO.Forms.SurfaceViewModel, Hive.IO",
      "Name": "srf0",
      "Area": 41.19041518967525
    }
  ]
}""")  # -> flatten(HiveEnergySystems)
hiveinputbuilding = InputBuildingHive(ZoneGeometry=brep, WindowsSurfaces=srf_2, SiaRoom="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")
hiveinputenvironment = InputEnvironmentHive(EpwPath=panel, ObstacleGeometries=[mesh_2, mesh_3, mesh])

# ----
hivedistributor = MainDistributorHive(HiveInputs=[hiveinputenvironment, hiveinputbuilding, hiveinputenergysystems])  # -> HiveBuilding, HiveEnvironment, HiveEnergySystemsSurfaceBasedTech, HiveEnergySystemsConversionTech, HiveEnergySystemsEmitter

# ---- group: shading mask rec level
toggle = BooleanToggle(False)
number_slider = Slider(3, range=0..5)
number_slider_2 = Slider(0.113, range=0..2)

# ---- group: sun vector HOY
toggle_2 = BooleanToggle(False)
number_slider_3 = Slider(2680, range=0..8759)

# ---- group: show sunpath
toggle_3 = BooleanToggle(False)

# ---- group: Simulate solar?
toggle_4 = BooleanToggle(False)

# ---- group: min (blue) to max (yellow) irradiation (kWh/m^2)
number_slider_4 = Slider(0, range=0..1000)
number_slider_5 = Slider(930.703, range=0..2000)

# ----
# Distributor
hivedistsolarsimu = DistributorSolarSimulationHive(
    HiveBuilding=hivedistributor.HiveBuilding,
    HiveSolarTechnologies=hivedistributor.HiveEnergySystemsSurfaceBasedTech,
    HiveEnvironment=hivedistributor.HiveEnvironment)  # -> EnvironmentMesh, BuildingCentroid, ExternalSurfaces, WindowGeometries, WindowTilt, WindowAzimuth, WindowAreas, SolarTechMesh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
hivedistconversiontech = DistributorConversionTechHive(ConversionTechnologies=hivedistributor.HiveEnergySystemsConversionTech)  # -> AirSourceHeatPump, Chiller, Boiler, CombinedHeatAndPower, HeatExchanger, ColdExchanger, DirectElectricity
hivedistsiaroom = DistributorSIARoomHive(HiveBuilding=hivedistributor.HiveBuilding)  # -> ZoneAreas, WindowsAreas, ExternalSurfacesAreas, SIA2024Room, AllExternalSurfaceAreas, SurfaceType
hivedistenvironment = DistributorEnvironmentHive(HiveEnvironment=hivedistributor.HiveEnvironment)  # -> Filepath, NaturalGas, BioGas, WoodPellets, DistrictHeating, DistrictCooling, GridElectricity, AmbientAirTemp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
bool = Boolean(toggle_4)
python = GhPythonScript(x=hivedistsolarsimu.WindowGeometries, y=bool)  # -> out, a
# ---------- python: Python ----------
__author__ = "chwaibel"
__version__ = "2020.09.09"

import rhinoscriptsyntax as rs

if y:
    a = x
# ---------- end python ----------
python_2 = GhPythonScript(x=hivedistsolarsimu.SolarTechMesh, y=toggle_4)  # -> out, a; same code as python
epw_reader = EPWReader(Path=hivedistenvironment.Filepath)  # -> Latitude, Longitude, CityCountry, GHI, DNI, DHI, DryBulb, DewPoint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
sia2024room = SIA2024RoomReader(Room=hivedistsiaroom.SIA2024Room, Area=hivedistsiaroom.ZoneAreas)  # -> Τ_h, Θ_i_C, T_h, A_op_m2, A_w_m2, U_op_W_m2K, U_w_W_m2K, V_e_m3_h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
adaptcomf = AdaptiveComfort(T_m=epw_reader.DryBulbMonthly)  # -> T_n, T_n80ub, T_n80lb, T_n90ub, T_n90lb

# ---- group: Upper temperature setpoint (°C)
panel_4 = Panel(adaptcomf.T_n90ub)

# ---- group: Lower temperature setpoint (°C)
panel_5 = Panel(adaptcomf.T_n90lb)

# ---- group: Monthly average dry bulb temperature (°C)
panel_6 = Panel(epw_reader.DryBulbMonthly)

# ---- group: checking windows order
item = ListItem(List=hivedistsolarsimu.WindowGeometries, Index=Slider(0, range=0..5), Wrap=True)
offset = OffsetSurface(Surface=item, Distance=0.5, Retrim=True)
preview = CustomPreview(Geometry=offset, Shader=ColourSwatch(SwatchColor=RGB(74, 207, 255)))

# ----
graph = QuickGraph([panel_4, panel_5, panel_6], SortOrder=0)
adaptivecomfort = AdaptiveComfort(AirTemperature=epw_reader.DryBulb)  # -> ThermalComfort, Comfort80UpperBound, Comfort80LowerBound, Comfort90UpperBound, Comfort90LowerBound

# ---- group: DHI
data = Data(epw_reader.DHI)

# ----
# Shading Mask
dni = Data(epw_reader.DNI)
panel_7 = Panel([epw_reader.Longitude, epw_reader.Latitude])
pt = Point(hivedistsolarsimu.BuildingCentroid)
skydome = GHSkydome(
    RecursionLevel=number_slider,
    Viewfactors=toggle,
    CumSkyMatrix=Toggle(False),
    SunPath=toggle_3,
    SolarVec=toggle_2,
    HOY=number_slider_3,
    Location=panel_7,
    DNI=dni,
    DHI=data,
    Size=number_slider_2,
    Context=hivedistsolarsimu.EnvironmentMesh,
    Sp=pt,
    Timezone=epw_reader.Timezone)  # -> Mesh, Vectors, Sunpaths, SunGeo
preview_2 = CustomPreview(Geometry=skydome.Sunpaths, Shader=ColourSwatch(SwatchColor=RGB(0, 0, 0)))

# ----
# SOLAR SIMULATION
num = Number(number_slider_5)
num_2 = Number(number_slider_4)
mesh_4 = Mesh(hivedistsolarsimu.ExternalSurfaces)
data_2 = Data([0.8, 0.8, 0.8, 0.8, 0.8, 0.8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])
obstobj = ObstacleObject(
    Mesh=[hivedistsolarsimu.EnvironmentMesh, mesh_4],
    Albedo=data_2,
    SpecCoeff=data_2,
    ReflType=0,
    Tolerance=0.01,
    Name="PV",
    MT=True)

# ----
# Solare Wärmeeinträge (shaded)
mesh_uv_2 = MeshSurface(Surface=python.a, UCount=panel_2, VCount=panel_3, Overhang=True, Equalize=False)  # -> flatten(Mesh)
mesh_5 = Mesh(mesh_uv_2)
obstobj_2 = ObstacleObject(Mesh=mesh_5, Albedo=data_2, SpecCoeff=data_2, ReflType=0, Tolerance=0.01, Name="PV", MT=True)
irrmshy = IrradiationMeshYear(
    AnalysisObjects=obstobj_2,
    ObstacleObjects=obstobj,
    Latitude=epw_reader.Latitude,
    Longitude=epw_reader.Longitude,
    Year=2017,
    DNI=epw_reader.DNI,
    DHI=epw_reader.DHI,
    MainSkyRes=1,
    SpecBounces=0,
    DiffIReflSkyRes=0,
    DiffIReflMode=2,
    MT=True,
    Timezone=epw_reader.Timezone)
readresults = ReadResults(Mesh=mesh_5, I=irrmshy, Value=7)  # -> simplify(Results), SP
visumshsol = VisualizeMeshSolar(Mesh=mesh_5, I=irrmshy, Value=0, Min=num_2, Max=num, Clr=0)

# ---- group: Windows
mesh_6 = Mesh(visumshsol)

# ----
# Solare Wärmeeinträge (unshaded)
simplepanel = SimplePanel(
    Tilt=hivedistsolarsimu.WindowTilt,
    Azimuth=hivedistsolarsimu.WindowAzimuth,
    DHI=epw_reader.DHI,
    DNI=epw_reader.DNI,
    Latitude=epw_reader.Latitude,
    Longitude=epw_reader.Longitude,
    Aw=hivedistsolarsimu.WindowAreas,
    Timezone=epw_reader.Timezone)

# ---- group: NEW SIA 380 COMPONENT
# DEMAND
sia380 = BuildingDemandSIA380(
    RoomProperties=hivedistsiaroom.SIA2024Room,
    FloorArea=hivedistsiaroom.ZoneAreas,
    AirTemperature=epw_reader.DryBulb,
    SetpointsUpperBounds=adaptivecomfort.Comfort90UpperBound,
    SetpointsLowerBounds=adaptivecomfort.Comfort90LowerBound,
    EnvelopeSurfaceAreas=hivedistsiaroom.AllExternalSurfaceAreas,
    EnvelopeSurfaceTypes=hivedistsiaroom.SurfaceType,
    SurfaceIrradiation=readresults.Results,
    SurfaceIrradiationUnobstructed=simplepanel,
    GValue=sia2024room.G_,
    GValueWithSunscreen=sia2024room.G_total_,
    SetpointSunscreen=sia2024room.G_T_W_m_2,
    RunObstructedSolarSimulation=bool)  # -> HeatingDemand, CoolingDemand, ElectricityDemand, TransmissionHeatLosses, VentilationHeatLosses, InternalGains, SolarGains, TransmissionHeatLossesOfOpaqueSurfaces, TransmissionHeatLossesOfTransparentSurfaces, SolarGainsPerTransparentSurface
abs = Absolute(Value=sia380.CoolingDemand)

# ----
sia380_2 = BuildingDemandSIA380(
    RoomProperties=hivedistsiaroom.SIA2024Room,
    FloorArea=hivedistsiaroom.ZoneAreas,
    AirTemperature=epw_reader.DryBulb,
    SetpointsUpperBounds=adaptivecomfort.Comfort90UpperBound,
    SetpointsLowerBounds=adaptivecomfort.Comfort90LowerBound,
    EnvelopeSurfaceAreas=hivedistsiaroom.AllExternalSurfaceAreas,
    EnvelopeSurfaceTypes=hivedistsiaroom.SurfaceType,
    SurfaceIrradiation=readresults.Results,
    SurfaceIrradiationUnobstructed=simplepanel,
    GValue=sia2024room.G_,
    GValueWithSunscreen=sia2024room.G_total_,
    SetpointSunscreen=sia2024room.G_T_W_m_2,
    RunObstructedSolarSimulation=bool,
    HourlyOrMonthly=Toggle(False))  # -> HeatingDemand, CoolingDemand, ElectricityDemand, TransmissionHeatLosses, VentilationHeatLosses, InternalGains, SolarGains, TransmissionHeatLossesOfOpaqueSurfaces, TransmissionHeatLossesOfTransparentSurfaces, SolarGainsPerTransparentSurface

# ----
# PV Ertrag (simuliert)
obstobj_3 = ObstacleObject(Mesh=python_2.a, Albedo=data_2, SpecCoeff=data_2, ReflType=0, Tolerance=0.01, Name="PV", MT=True)
irrmshy_2 = IrradiationMeshYear(
    AnalysisObjects=obstobj_3,
    ObstacleObjects=obstobj,
    Latitude=epw_reader.Latitude,
    Longitude=epw_reader.Longitude,
    Year=2017,
    DNI=epw_reader.DNI,
    DHI=epw_reader.DHI,
    MainSkyRes=1,
    SpecBounces=0,
    DiffIReflSkyRes=0,
    DiffIReflMode=2,
    MT=True,
    Timezone=0)
visumshsol_2 = VisualizeMeshSolar(Mesh=hivedistsolarsimu.SolarTechMesh, I=irrmshy_2, Value=0, Min=num_2, Max=num)

# ---- group: PV Panels
mesh_7 = Mesh(visumshsol_2)

# ----
q_t = Panel("""2019.188256
1442.144948
674.475524
176.414787
0
0
0
0
5.178783
294.165603
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""")

# ----
# PV Ertrag (unverschattet)
# Q_s = G * F_F * A_w * g
# [Q_s] = kWh
# [G] = kWh/m^2
# [F_F] = -
# [A_w] = m^2
# [g] = -
simplepanel_2 = SimplePanel(
    Tilt=hivedistsolarsimu.SolarTechTilt,
    Azimuth=hivedistsolarsimu.SolarTechAzimuth,
    DHI=epw_reader.DHI,
    DNI=epw_reader.DNI,
    Latitude=epw_reader.Latitude,
    Longitude=epw_reader.Longitude)

viewer = ParamViewer(sia380.SolarGainsPerTransparentSurface)
panel_8 = Panel([sia380.HeatingDemand, sia380.CoolingDemand, sia380.ElectricityDemand, sia380.TransmissionHeatLosses, sia380.VentilationHeatLosses, sia380.InternalGains, sia380.SolarGains, sia380.TransmissionHeatLossesOfOpaqueSurfaces, sia380.TransmissionHeatLossesOfTransparentSurfaces])
panel_9 = Panel(sia380.CoolingDemand)
subtraction = Subtraction(A=q_t, B=panel_8)
ma = MassAddition(Input=sia380.HeatingDemand)  # -> Result, PartialResults
ma_2 = MassAddition(Input=sia380_2.HeatingDemand)  # -> Result, PartialResults
cluster = Cluster(first_number=q_t, second_number=panel_8)
ma_3 = MassAddition(Input=sia380.SolarGains)  # -> Result, PartialResults
panel_10 = Panel(sia380.SolarGainsPerTransparentSurface)
panel_11 = Panel(ma.Result)
panel_12 = Panel(ma_2.Result)
panel_13 = Panel(epw_reader.DryBulb)
panel_14 = Panel(cluster)
panel_15 = Panel(sia380_2.HeatingDemand)
number_slider_6 = Slider(5000, range=0..10000)
addition = Addition(A=number_slider_6, B=Slider(168, range=0..10000))
dom = ConstructDomain(DomainStart=number_slider_6, DomainEnd=addition)
subset = SubList(List=panel_15, Domain=dom, Wrap=True)  # -> List, Index
subset_2 = SubList(List=[sia380_2.CoolingDemand, panel_15], Domain=dom, Wrap=True)  # -> List, Index
subset_3 = SubList(List=epw_reader.DryBulb, Domain=dom, Wrap=True)  # -> List, Index
subset_4 = SubList(List=adaptivecomfort.Comfort90UpperBound, Domain=dom, Wrap=True)  # -> List, Index
subset_5 = SubList(List=adaptivecomfort.Comfort90LowerBound, Domain=dom, Wrap=True)  # -> List, Index
subset_6 = SubList(List=sia380_2.TransmissionHeatLosses, Domain=dom, Wrap=True)  # -> List, Index
subset_7 = SubList(List=sia380_2.VentilationHeatLosses, Domain=dom, Wrap=True)  # -> List, Index
subset_8 = SubList(List=sia380_2.InternalGains, Domain=dom, Wrap=True)  # -> List, Index
subset_9 = SubList(List=sia380_2.SolarGains, Domain=dom, Wrap=True)  # -> List, Index
graph_2 = QuickGraph([subset.List, subset_2.List], SortOrder=0)
graph_3 = QuickGraph([subset_3.List, subset_4.List, subset_5.List], SortOrder=0)
graph_4 = QuickGraph([subset_6.List, subset_7.List, subset_8.List, subset_9.List], SortOrder=0)
python_3 = GhPythonScript(emitters=hivedistributor.HiveEnergySystemsEmitter)  # -> out, monthlyHeatingSupTemp, monthlyCoolingSupTemp, heatingCarrier, monthlyHeatingReturnTemp, yearlyHeatingSupTemp, yearlyHeatingReturnTemp, monthlyCoolingReturnTemp; inputs emitters: list
# ---------- python_3: Python ----------
__author__ = "chwaibel"
__version__ = "2020.08.20"

import rhinoscriptsyntax as rs

for e in emitters:
    if e.IsCooling:
        monthlyCoolingSupTemp = e.InletCarrier.MonthlyTemperature
        monthlyCoolingReturnTemp = e.ReturnCarrier.MonthlyTemperature
    else:
        monthlyHeatingSupTemp = e.InletCarrier.MonthlyTemperature
        heatingCarrier = e
        monthlyHeatingReturnTemp = e.ReturnCarrier.MonthlyTemperature
        yearlyHeatingSupTemp = e.InletCarrier.Temperature
        yearlyHeatingReturnTemp = e.ReturnCarrier.Temperature
# ---------- end python_3 ----------

# ---- group: Simple efficiency calculations?
toggle_5 = BooleanToggle(False)

# ----
# Chiller
hivemergerchiller = MergerChillerHive(
    AirCarrier=hivedistenvironment.AmbientAirTemp,
    ElectricityCarrier=hivedistenvironment.GridElectricity,
    CoolingGenerated=abs,
    SupplyTemperature=python_3.monthlyCoolingSupTemp,
    SimpleMode=toggle_5,
    HiveChiller=hivedistconversiontech.Chiller)

# ----
# Air Source Heat Pump
hivemergerashp = MergerAirSourceHeatPumpHive(
    AirCarrier=hivedistenvironment.AmbientAirTemp,
    ElectricityCarrier=hivedistenvironment.GridElectricity,
    HeatingGenerated=sia380.HeatingDemand,
    SupplyTemperature=python_3.monthlyHeatingSupTemp,
    SimpleMode=toggle_5,
    HiveAirSourceHeatPump=hivedistconversiontech.AirSourceHeatPump)

# ----
# PV / ST
python_4 = GhPythonScript(x=irrmshy_2)  # -> out, a
# ---------- python_4: Python ----------
__author__ = "chwaibel"
__version__ = "2020.08.21"

import rhinoscriptsyntax as rs

a = x.I_hourly
# ---------- end python_4 ----------
hivemergersolartech = MergerSolarTechHive(
    I_hourlyM=python_4.a,
    SolarTechnologies=hivedistributor.HiveEnergySystemsSurfaceBasedTech,
    AirCarrier=hivedistenvironment.AmbientAirTemp,
    SupplyTemperature=python_3.yearlyHeatingSupTemp,
    ReturnTemperature=python_3.yearlyHeatingReturnTemp,
    SimpleMode=toggle_5,
    I_hourly=simplepanel_2)
python_5 = GhPythonScript(x=hivemergersolartech)  # -> out, a
# ---------- python_5: Python ----------
__author__ = "chwaibel"
__version__ = "2020.08.24"

import rhinoscriptsyntax as rs
a = x.OutputCarriers[0].MonthlyCumulativeEnergy
# ---------- end python_5 ----------
panel_16 = Panel(hivemergersolartech)
ma_4 = MassAddition(Input=python_5.a)  # -> Result, PartialResults
graph_5 = QuickGraph(python_5.a, SortOrder=0)
panel_17 = Panel(ma_4.Result)

# ---- group: PV electricity generation (kWh/month)
panel_18 = Panel(python_5.a)

# ----
# Plug-in any conversion tech
python_6 = GhPythonScript(x=hivemergerchiller)  # -> out, description, outEnergy
# ---------- python_6: Python ----------
__author__ = "chwaibel"
__version__ = "2020.08.18"

import rhinoscriptsyntax as rs

a = ("total investment cost: ", x.SpecificInvestmentCost * x.Capacity)
b = ("capacity: ", x.Capacity)
c = ("cap unit; ", x.CapacityUnit)
d = ("name: ", x.Name)
e = ("opCost CHF/a: ", sum(x.InputCarrier.TotalEnergyCost))
f = ("tot Input Energy kWh/a: ", sum(x.InputCarrier.Energy))
g = ("Tot Output Energy kWh/a: ", sum(x.OutputCarriers[0].MonthlyCumulativeEnergy))
h = ("Inp Car PEF: ", x.InputCarrier.PrimaryEnergyFactor)
description = [a, b, c, d, e, f, g, h]

# print(x.InputCarrier.MonthlyCumulativeEnergy)
#print(x.OutputCarriers[0].Energy)
print(x.InputCarrier.PrimaryEnergyFactor)
print("Input type: ", type(x.InputCarrier))
print("Output type: ", type(x.OutputCarriers[0]))
outEnergy = x.OutputCarriers[0].MonthlyCumulativeEnergy
print(x.IsCooling)
# ---------- end python_6 ----------
panel_19 = Panel(python_6.description)

# ----
# Purchased Grid Electricity
python_7 = GhPythonScript(chiller=hivemergerchiller, ashp=hivemergerashp, siaElec=sia380.ElectricityDemand)  # -> out, additionalElec; inputs siaElec: list
# ---------- python_7: Python ----------
__author__ = "Christoph"
__version__ = "2020.09.13"

import rhinoscriptsyntax as rs
if chiller != None and ashp != None:
    additionalElec = [a+b+c for a,b,c in zip(chiller.InputCarrier.MonthlyCumulativeEnergy, ashp.InputCarrier.MonthlyCumulativeEnergy, siaElec)]
elif ashp != None and chiller is None:
    additionalElec = [a+b for a,b in zip(ashp.InputCarrier.MonthlyCumulativeEnergy, siaElec)]
elif ashp is None and chiller != None:
    additionalElec = [a+b for a,b in zip(chiller.InputCarrier.MonthlyCumulativeEnergy, siaElec)]
else:
    additionalElec = siaElec
# ---------- end python_7 ----------
python_8 = GhPythonScript(pvOrStList=hivemergersolartech, elecDemandIn=python_7.additionalElec, heatDemandIn=sia380.HeatingDemand)  # -> out, flatten(elecDemandOut), heatDemandOut; inputs pvOrStList: list, elecDemandIn: list, heatDemandIn: list
# ---------- python_8: Python ----------
__author__ = "Christoph"
__version__ = "2020.09.13"

import rhinoscriptsyntax as rs
import Hive.IO.EnergySystems

months = 12
totalRenewableHeat = [0.0] * months
totalRenewableElec = [0.0] * months

for pvOrSt in pvOrStList:
    if(pvOrSt != None):
        energyRenewable = pvOrSt.OutputCarriers[0].MonthlyCumulativeEnergy
    
    if(type(pvOrSt) == Hive.IO.EnergySystems.Photovoltaic):
        totalRenewableElec = [x + y for x, y in zip (totalRenewableElec, energyRenewable)]
    elif(type(pvOrSt) == Hive.IO.EnergySystems.SolarThermal):
        totalRenewableHeat = [x + y for x, y in zip (totalRenewableHeat, energyRenewable)]

elecDemandOut = [x - y for x, y in zip(elecDemandIn, totalRenewableElec)]
heatDemandOut = [x - y for x, y in zip(heatDemandIn, totalRenewableHeat)]
# ---------- end python_8 ----------
hivemergerdirectelectricity = MergerDirectElectricityHive(
    ElectricityCarrier=hivedistenvironment.GridElectricity,
    ElectricityPurchased=python_8.elecDemandOut,
    DirectElectricity=hivedistconversiontech.DirectElectricity)

# ----
# Results
hiveresults = ResultsHive(
    CoolingMonthly=abs,
    HeatingMonthly=python_8.heatDemandOut,
    ElectricityMonthly=python_8.elecDemandOut,
    HiveBuilding=hivedistributor.HiveBuilding,
    HiveConversionTech=flatten([hivemergerdirectelectricity, hivemergerchiller, hivemergerashp, hivemergersolartech]),
    Q_T_opaque=sia380.TransmissionHeatLossesOfOpaqueSurfaces,
    Q_T_transparent=sia380.TransmissionHeatLossesOfTransparentSurfaces,
    Q_V=sia380.VentilationHeatLosses,
    Q_i=sia380.InternalGains,
    Q_s=sia380.SolarGains,
    ConsumedElec=python_7.additionalElec,
    ConsumedHeat=sia380.HeatingDemand,
    Q_s_per_win=sia380.SolarGainsPerTransparentSurface)
python_9 = GhPythonScript(hiveResults=hiveresults)  # -> out, a, heatingLoads, coolingLoads, electricityLoads, windowSolarGains, gainsAndLosses
# ---------- python_9: Python ----------
__author__ = "chwaibel"
__version__ = "2020.09.23"

x = hiveResults

import rhinoscriptsyntax as rs

heatingLoads = x.TotalFinalHeatingMonthly
coolingLoads = x.TotalFinalCoolingMonthly
electricityLoads = x.TotalFinalElectricityMonthly
windowSolarGains = [] 
for j in range(len(x.MonthlySolarGainsPerWindow)):
    window = x.MonthlySolarGainsPerWindow[j]
    for i in range(len(window)):
        if i==0:
            windowSolarGains.append("______")
            windowSolarGains.append("window " + str(j))
        windowSolarGains.append(window[i])
        

gainsAndLosses = []
gainsAndLossesDict = \
{"SolarGains: ": x.TotalSolarGains, \
"InternalGains: ": x.TotalInternalGains, \
"PrimaryEnergy: ": sum(x.TotalPrimaryEnergyMonthlyNonRenewable), \
"VentilationHeatGains: ": x.TotalVentilationHeatGains, \
"EnvelopeHeatGains: ": x.TotalOpaqueTransmissionHeatGains, \
"WindowHeatGains: ": x.TotalWindowTransmissionHeatGains, \
"ElectricityDemand: ": sum(x.TotalConsumedElectricityMonthly), \
"VentilationHeatLosses: ": x.TotalVentilationHeatLosses, \
"EnvelopeHeatLosses: ": x.TotalOpaqueTransmissionHeatLosses, \
"WindowHeatLosses: ": x.TotalWindowTransmissionHeatLosses, \
"SystemConversionLosses: ": x.TotalSystemLosses}

for k, v in gainsAndLossesDict.iteritems():
    gainsAndLosses.append(k + str(v))
# ---------- end python_9 ----------

hive_io_visualizer = HiveIOVisualizer(
    hiveresults,
    PlotProperties="""{
  "$type": "System.Collections.Generic.Dictionary`2[[System.String, mscorlib],[System.String, mscorlib]], mscorlib"
}""")

# ---- group: Zone Gains and Losses
panel_20 = Panel(python_9.gainsAndLosses)

# ---- group: Heating Loads
panel_21 = Panel(python_9.heatingLoads)

# ---- group: Cooling Loads
panel_22 = Panel(python_9.coolingLoads)

# ---- group: Windows Solar Gains
panel_23 = Panel(python_9.windowSolarGains)

# ---- group: Electricity Loads
panel_24 = Panel(python_9.electricityLoads)

# ---- group: Hive Results
data_3 = Data(hiveresults)

# ---- group: internalise data to store results
hiveresults_2 = HiveResultsParameter(data_3)

# ==== cluster Cluster
first_number = ClusterInput()
second_number = ClusterInput()
equality = Equality(FirstNumber=first_number, SecondNumber=second_number)  # -> Equality, Inequality
mass_addition = MassAddition(Input=equality.Equality)  # -> Result, PartialResults
list_length = ListLength(List=equality.Equality)
equality_2 = Equality(FirstNumber=list_length, SecondNumber=mass_addition.Result)  # -> Equality, Inequality
equality_3 = ClusterOutput(equality_2.Equality)
