# Grasshopper definition Hive_Distributor_Test.gh (Grasshopper 1.0.7)
# plug-ins: HiveIO, Hive.Core.sia380Parameters

sia2024roomsexisting = SIA2024ExistingRooms({"1.1 Wohnen Mehrfamilienhaus": {"U-Wert opake Bauteile": 0.80000000000000004, "description": "1.1 Wohnen Mehrfamilienhaus", "Temperatur-Aenderungsgrad der Waermerueckgewinnung": NaN, "Waermeeintragsleistung Personen (bei 24.0 deg C, bzw. 70 W)": 2.2999999999999998, "Jaehrliche Vollaststunden der Geraete": 1780.0, "Waermeeintragsleistung der Raumbeleuchtung": 2.7000000000000002, "Emissionen transparente Bauteile": 50.0, "Emissionen opake Bauteile": 64.0, "Gesamtenergiedurchlassgrad Verglasung und Sonnenschutz": 0.20000000000000001, "Glasanteil": 30.0, "Raumlufttemperatur Auslegung Heizen (Winter)": 21.0, "Jaehrliche Vollaststunden der Raumbeleuchtung": 1450.0, "Kosten transparente Bauteile": 420.0, "Waermeeintragsleistung der Geraete": 10.0, "Strahlungsleistung fuer Betaetigung Sonnenschutz": 200.0, "Vollaststunden pro Jahr (Personen)": 4090.0, "Gesamtenergiedurchlassgrad Verglasung": 0.65000000000000002, "U-Wert Fenster": 1.5, "Thermische Gebaeudehuellflaeche": 26.0, "Zeitkonstante": 68.0, "Aussenluft-Volumenstrom (pro NGF)": 1.0, "Raumlufttemperatur Auslegung Kuehlung (Sommer)": 26.0, "Abminderungsfaktor fuer Fensterrahmen": 0.75, "Aussenluft-Volumenstrom durch Infiltration": 0.29999999999999999, "Nettogeschossflaeche": 20.0, "Kosten opake Bauteile": 268.0}, "1.2 Wohnen Einfamilienhaus": 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, "2.1 Hotelzimmer": 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, "2.2 Empfang, Lobby": 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, "3.1 Einzel-, Gruppenbuero": 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, "3.2 Grossraumbuero": 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}, selected="1.1 Wohnen Mehrfamilienhaus")
panel = Panel("C:\Users\Christoph\Documents\GitHub\hive\GrasshopperExamples\LectureExercises\HIVE_Zurich.epw")
mesh = Mesh(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)
panel_2 = Panel("C:\Users\maxze\Documents\Hive\hive\GrasshopperExamples\LectureExercises\HIVE_Zurich.epw")
mesh_2 = Mesh(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)
mesh_3 = Mesh(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)
brep = Brep(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)
hiveinputenergysystems = InputEnergySystemsHive(
    MeshSolarTechnologyProperties=[mesh_3, mesh, mesh_2],
    conversions="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",
    emitters="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",
    meshConnections="""{
  "$type": "System.Collections.Generic.Dictionary`2[[System.Int32, mscorlib],[System.Int32, mscorlib]], mscorlib",
  "0": 1,
  "1": 2,
  "2": 3
}""",
    meshes="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")  # -> flatten(HiveEnergySystems)
srf = Surface([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])
hiveinputenvironment = InputEnvironmentHive(EpwPath=panel_2)
hiveinputbuilding = InputBuildingHive(ZoneGeometry=brep, WindowsSurfaces=srf, SIA2024Room=sia2024roomsexisting)
hiveiodistr = HiveIODistributor(HiveInputObjects=[hiveinputbuilding, hiveinputenergysystems, hiveinputenvironment])  # -> HiveIOBuilding, HiveIOEnvironment, HiveIOEnergySystemSurfaceBasedTech, HiveIOEnergySystemConversionTech, HiveIOEnergySystemsEmitter
hivedistsolarsimu = DistributorSolarSimulationHive(
    HiveBuilding=hiveiodistr.HiveIOBuilding,
    HiveSolarTechnologies=hiveiodistr.HiveIOEnergySystemSurfaceBasedTech,
    HiveEnvironment=hiveiodistr.HiveIOEnvironment)  # -> EnvironmentMesh, BuildingCentroid, ExternalSurfaces, WindowGeometries, WindowTilt, WindowAzimuth, WindowAreas, SolarTechMesh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
hivedistsolartech = DistributorSolarTechHive(HiveSurfaceBasedTech=hiveiodistr.HiveIOEnergySystemSurfaceBasedTech)  # -> EfficiencyPhotovoltaic, PhotovoltaicAreas, EfficiencySolarThermal, SolarThermalAreas, ElectricEfficiencyHybridPVT, ThermalEfficiencyHybridPVT, HybridPVTAreas
hivedistconversiontech = DistributorConversionTechHive(ConversionTechnologies=hiveiodistr.HiveIOEnergySystemConversionTech)  # -> AirSourceHeatPump, Chiller, Boiler, CombinedHeatAndPower, HeatExchanger, ColdExchanger, DirectElectricity
hivedistemitter = DistributorEmitterHive(Emitters=hiveiodistr.HiveIOEnergySystemsEmitter)  # -> HourlyHtgSupTemp, HourlyHtgRetTemp, HourlyClgSupTemp, HourlyClgRetTemp
hivedistsiaroom = DistributorSIARoomHive(HiveBuilding=hiveiodistr.HiveIOBuilding)  # -> NetZoneAreas, WindowsAreas, ExternalSurfacesAreas, SIA2024Room, AllExternalSurfaceAreas, SurfaceType, SUARoomSchedules, UseAdaptiveComfort, UseNaturalVentilation, UseFixedTimeConstant
hivedistenvironment = DistributorEnvironmentHive(HiveEnvironment=hiveiodistr.HiveIOEnvironment)  # -> EPW, NaturalGas, BioGas, WoodPellets, DistrictHeating, DistrictCooling, GridElectricity, AmbientAirTemp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

# ---- group: Helsinki EPW
panel_3 = Panel("C:\Users\maxze\Documents\Hive\hive\GrasshopperExamples\LectureExercises\HIVE_Helsinki.epw")

# ----
distepw = DistributorEPW(EPW=hivedistenvironment.EPW, EPWFilepath=panel_3, WriteGHNumbers=Toggle(True))  # -> EPW, Latitude, Longitude, CityCountry, GHI, DNI, DHI, DryBulb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
panel_4 = Panel(distepw.CityCountry)
