# Grasshopper definition Hive_Solar_Test.gh (Grasshopper 1.0.7)
# plug-ins: HiveIO

panel = Panel("C:\Users\christoph\Documents\GitHub\hive\GrasshopperExamples\LectureExercises\HIVE_Zurich.epw")
srf = Surface(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)
panel_2 = Panel("C:\Users\maxze\Documents\Hive\hive\GrasshopperExamples\LectureExercises\HIVE_Zurich.epw")
mesh_uv = MeshSurface(Surface=srf, UCount=5, VCount=5, Overhang=True, Equalize=False)
srf_2 = Surface(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)
brep = Brep(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)
hiveinputenergysystems = InputEnergySystemsHive(
    MeshSolarTechnologyProperties=mesh_uv,
    conversions="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",
    emitters="""{
  "$type": "Hive.IO.Forms.EmitterPropertiesViewModel[], Hive.IO",
  "$values": []
}""",
    meshConnections="""{
  "$type": "System.Collections.Generic.Dictionary`2[[System.Int32, mscorlib],[System.Int32, mscorlib]], mscorlib"
}""",
    meshes="""{
  "$type": "Hive.IO.Forms.SurfaceViewModel[], Hive.IO",
  "$values": [
    {
      "$type": "Hive.IO.Forms.SurfaceViewModel, Hive.IO",
      "Name": "srf0",
      "Area": 44.00082650533399
    }
  ]
}""")  # -> flatten(HiveEnergySystems)
hiveinputenvironment = InputEnvironmentHive(EpwPath=panel_2)
hiveinputbuilding = InputBuildingHive(ZoneGeometry=brep, WindowsSurfaces=srf_2, SiaRoom="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")
hivedistributor = MainDistributorHive(HiveInputs=[hiveinputenergysystems, hiveinputbuilding, hiveinputenvironment])  # -> HiveBuilding, HiveEnvironment, HiveEnergySystemsSurfaceBasedTech, HiveEnergySystemsConversionTech, HiveEnergySystemsEmitter
hivedistepw = DistributorEPW(EPWFilepath=panel_2, WriteGHNumbers=Toggle(True))  # -> EPW, Latitude, Longitude, CityCountry, GHI, DNI, DHI, DryBulb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
hivedistsolarsimu = DistributorSolarSimulationHive(
    HiveBuilding=hivedistributor.HiveBuilding,
    HiveSolarTechnologies=hivedistributor.HiveEnergySystemsSurfaceBasedTech,
    HiveEnvironment=hivedistributor.HiveEnvironment)  # -> EnvironmentMesh, BuildingCentroid, ExternalSurfaces, WindowGeometries, WindowTilt, WindowAzimuth, WindowAreas, SolarTechMesh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
solarpotentialsunobstructed = SolarPotentialsUnobstructed(
    Tilt=hivedistsolarsimu.WindowTilt,
    Azimuth=hivedistsolarsimu.WindowAzimuth,
    DHI=hivedistepw.DHI,
    DNI=hivedistepw.DNI,
    Latitude=hivedistepw.Latitude,
    Longitude=hivedistepw.Longitude,
    Aw=hivedistsolarsimu.WindowAreas,
    Timezone=hivedistepw.Timezone)
graph = QuickGraph(solarpotentialsunobstructed, SortOrder=0)
panel_3 = Panel(solarpotentialsunobstructed)
