# Grasshopper definition Hive_Distributor_Test.gh (Grasshopper 1.0.7)
# plug-ins: HiveIO

mesh = Mesh(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)
io_pv = HiveIOPV(Mesh=mesh)  # -> PVObj, Eff, Name, Geo
io_pv_2 = HiveIOPV(Mesh=mesh)  # -> PVObj, Eff, Name, Geo
io_pvt = HiveIOPVT(Mesh=mesh, Refeffthermal="0.2", Reffeffelectric="0.2")
distributor = Distributor(HiveInputObjects=[io_pv_2.PVObj, io_pvt, io_pv.PVObj])
