# Grasshopper definition Hive_Form_Building_GeometryIsValid.gh (Grasshopper 1.0.7)
# plug-ins: HiveIO, sia380Parameters

# ---- group: IsValid
brep = Brep(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)

# ---- group: non-convex
brep_2 = Brep(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)
brep_3 = Brep(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)

# ---- group: non-linear
brep_4 = Brep(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)

# ---- group: open
brep_5 = Brep(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)

# ----
rooms_existing = RoomsExisting({"1.1 Wohnen Mehrfamilienhaus": {"description": "1.1 Wohnen Mehrfamilienhaus", "Raumlufttemperatur Auslegung Heizen (Winter)": 21.0, "Nettogeschossflaeche": 20.0, "Thermische Gebaeudehuellflaeche": 26.0, "U-Wert Fenster": 1.5, "Waermeeintragsleistung Personen (bei 24.0 deg C, bzw. 70 W)": 2.2999999999999998, "Jaehrliche Vollaststunden der Geraete": 1780.0, "U-Wert opake Bauteile": 0.80000000000000004, "Jaehrliche Vollaststunden der Raumbeleuchtung": 1450.0, "Vollaststunden pro Jahr (Personen)": 4090.0, "Abminderungsfaktor fuer Fensterrahmen": 0.75, "Aussenluft-Volumenstrom durch Infiltration": 0.29999999999999999, "Raumlufttemperatur Auslegung Kuehlung (Sommer)": 26.0, "Glasanteil": 30.0, "Zeitkonstante": 68.0, "Waermeeintragsleistung der Raumbeleuchtung": 2.7000000000000002, "Waermeeintragsleistung der Geraete": 10.0, "Gesamtenergiedurchlassgrad Verglasung": 0.65000000000000002, "Temperatur-Aenderungsgrad der Waermerueckgewinnung": NaN, "Aussenluft-Volumenstrom (pro NGF)": 1.0}, "1.2 Wohnen Einfamilienhaus": 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, "2.1 Hotelzimmer": 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, "2.2 Empfang, Lobby": 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, "3.1 Einzel-, Gruppenbuero": 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, "3.2 Grossraumbuero": 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, "3.3 Sitzungszimmer": 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, "3.4 Schalterhalle, Empfang": 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, "4.1 Schulzimmer": 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, "4.2 Lehrerzimmer": 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}, selected="1.1 Wohnen Mehrfamilienhaus")
hive_io_building = HiveIOBuilding(ZoneGeometry=brep, SIA2024dict=rooms_existing)
panel = Panel(hive_io_building)
