# Grasshopper definition Hive_Form_PV.gh (Grasshopper 1.0.7)
# plug-ins: HiveIO

mesh = Mesh(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)
io_pv = HiveIOPV(Mesh=mesh)  # -> PVObj, Eff, Name, Geo
panel = Panel(io_pv.Name)
panel_2 = Panel(io_pv.Geo)
panel_3 = Panel(io_pv.PVObj)
panel_4 = Panel(io_pv.Eff)
distributor = Distributor(HiveInputObjects=panel_3)
