# Grasshopper definition Hive_Results_Test.gh (Grasshopper 1.0.7)
# plug-ins: HiveIO

# ---- group: elec
data = Data(["3.852624", "3.852624", "3.852624", "3.852624", "3.852624", "3.852624", "3.852624", "3.852624", "3.852624", "3.852624", "3.852624", "3.852624"])

# ---- group: heating
data_2 = Data(["50.029929", "37.862895", "25.837209", "8.7003", "0.741364", "0.007886", "0.000672", "0.002471", "2.258486", "16.063257", "35.74919", "48.328382"])

# ----
ghresults = GHResults(HtgMonthly=data_2, ElecMonthly=data)
panel = Panel(ghresults)
