# Grasshopper definition simple_panel.gh (Grasshopper 1.0.7)
# plug-ins: solar

simplepanel = SimplePanel(Tilt=Slider(46.44, range=0..90), Azimuth=Slider(84.706, range=0..360))  # -> AnnualPotential, Beam, Diff, Diff_refl
graph = QuickGraph(simplepanel.Beam, SortOrder=0)
