# Grasshopper definition simple_hp.gh (Grasshopper 1.0.7)
# plug-ins: heatpumps

hp_cop = SimpleHpCop(Eta="0.8", T_1="28", T_2="20")
simple_hp = SimpleHp(Q_th="100", COP=hp_cop)
panel = Panel(simple_hp)
