# Grasshopper definition simple_pv.gh (Grasshopper 1.0.7)
# plug-ins: HiveIO

# ---- group: replace with grasshopper component that reads a surface of a building
number_slider = Slider(99.53, range=0..360)
number_slider_2 = Slider(34.366, range=0..90)

# ----
data = Data([0, 0, 0, 0, 0, 0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])
data_2 = Data([0, 0, 0, 0, 0, 0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])
solarpotentialsunobstructed = SolarPotentialsUnobstructedCSharp(
    Tilt=[Slider(0, range=0..90), number_slider_2],
    Azimuth=[Slider(180, range=0..360), number_slider],
    DHI=data,
    DNI=data_2,
    Latitude=47.36667,
    Longitude=8.55,
    Aw=1,
    Timezone=0)
sumpvyield = SummarizePVElectricityYieldCSharp(Sum_mode="year", Elec=solarpotentialsunobstructed)
graph = QuickGraph(solarpotentialsunobstructed, SortOrder=0)
item = TreeItem(Tree=sumpvyield, Path="{0;0;1;0}", Index="0", Wrap=True)
item_2 = TreeItem(Tree=sumpvyield, Path="{0;0;0;0}", Index="0", Wrap=True)
panel = Panel(item)
panel_2 = Panel(item_2)
orientationfactor = SolarOrientationFactorCSharp(G_flat=item_2, G_angled=item)
performanceratio = SolarPerformanceRatio({"Roof perfect": 0.85, "Roof normal": 0.75, "Roof dirty": 0.7, "Facade perfect": 0.75, "Facade normal": 0.7, "Facade shaded": 0.6}, selected="Roof perfect")
panel_3 = Panel(orientationfactor)
division = Division(A=item_2, B="1000")
pvsimple = PhotovoltaicEnergySystemCSharp(Global_Irradiation=division, FormFactor=panel_3, SurfaceArea="10", PVEfficiency=0.15, PerformanceRatio=performanceratio)
panel_4 = Panel(pvsimple)
panel_5 = Panel(sumpvyield)
flatten = FlattenTree(Tree=panel_5, Path="{0}")
panel_6 = Panel(flatten)
